# Grasshopper definition A2.gh (Grasshopper 1.0.7)

slit_height_factor = Slider(0.25, range=0..1)
# Width of each slit. Set this to match the width of the material that you are cutting.
# This variable drives the height of each slit relative to the height of the outer bounding rectangle.
slit_width = Slider(0.188, range=0..1)
# This variable represents the distance from the left edge of the outer bounding rectangle to the first slit.
slit_distance_from_edge = Slider(0.5, range=0..1)
rectangle_height = Slider(1, range=0..10)
# input values that effect the final curve's geometry.
# Outer bounding rectangle that determines the size of the final shape
rectangle_width = Slider(6, range=0..10)
multiplication = Multiplication(A=rectangle_height, B=slit_height_factor)
# This rectangle represents a single slit.
rectangle = Rectangle(Plane=PlaneXY(0, 0, 0), XSize=slit_width, YSize=multiplication, Radius=0)  # -> Rectangle, Length
integer = Integer(-2)
integer_2 = Integer(3)
division = Division(A=slit_width, B=integer)
multiplication_2 = Multiplication(A=slit_distance_from_edge, B=integer_2)
subtraction = Subtraction(A=rectangle_height, B=multiplication)
number = Number(0.01)
vector_xyz = VectorXYZ(XComponent=division, YComponent=0, ZComponent=0)  # -> Vector, Length
subtraction_2 = Subtraction(A=rectangle_width, B=multiplication_2)
addition = Addition(A=subtraction, B=number)
# The slits belonging to the same edge will always have the following distance between them: OuterBoundingRectangleWidth - (DistanceBetweenLeftEdgeAndFirstSlit * 3).
vector_xyz_2 = VectorXYZ(XComponent=subtraction_2, YComponent=0, ZComponent=0)  # -> Vector, Length
# Move the slit such that it is centered on the y-axis.
move = Move(Geometry=rectangle.Rectangle, Motion=vector_xyz.Vector)  # -> Geometry, Transform
vector_xyz_3 = VectorXYZ(XComponent=slit_distance_from_edge, YComponent=addition, ZComponent=0)  # -> Vector, Length
# This number = 2. The number of slits that should be included in each array, or on each side (top & bottom) of the outer bounding rectangle.
integer_3 = Integer(2)
integer_4 = Integer(2)
# This array represents the top two slits.
linear_array = LinearArray(Geometry=move.Geometry, Direction=vector_xyz_2.Vector, Count=integer_3)  # -> Geometry, Transform
# This array represents the bottom two slits.
linear_array_2 = LinearArray(Geometry=move.Geometry, Direction=vector_xyz_2.Vector, Count=integer_3)  # -> Geometry, Transform
number_2 = Number(-0.01)
multiplication_3 = Multiplication(A=slit_distance_from_edge, B=integer_4)
vector_xyz_4 = VectorXYZ(XComponent=multiplication_3, YComponent=number_2, ZComponent=0)  # -> Vector, Length
# Move the top two slits to the right to position them correctly based on the distance between the left edge and the first slit.
# 
# Additionally, move the top slits up slightly so that they do not perfectly intersect with the outer bounding rectangle so that they can be properly trimmed.
move_2 = Move(Geometry=linear_array.Geometry, Motion=vector_xyz_3.Vector)  # -> Geometry, Transform
# Move the bottom two slits to the right to position them correctly based on the distance between the left edge and the first slit.
# 
# Additionally, move the bottom slits down slightly so that they do not perfectly intersect with the outer bounding rectangle so that they can be properly trimmed.
move_3 = Move(Geometry=linear_array_2.Geometry, Motion=vector_xyz_4.Vector)  # -> Geometry, Transform
rectangle_2 = Rectangle(Plane=PlaneXY(0, 0, 0), XSize=rectangle_width, YSize=rectangle_height, Radius=0)  # -> Rectangle, Length
trim_with_regions = TrimWithRegions(Curve=move_3.Geometry, Regions=rectangle_2.Rectangle)  # -> flatten(Inside), flatten(Outside)
# Trim the outer bounding rectangle withe the bottom slits and vice versa.
trim_with_regions_2 = TrimWithRegions(Curve=rectangle_2.Rectangle, Regions=move_3.Geometry)  # -> flatten(Inside), flatten(Outside)
# Join the resulting curves.
join_curves = JoinCurves(Curves=[trim_with_regions.Inside, trim_with_regions_2.Outside], Preserve=False)
trim_with_regions_3 = TrimWithRegions(Curve=move_2.Geometry, Regions=join_curves)  # -> flatten(Inside), Outside
# Trim the outer bounding rectangle withe the top slits and vice versa.
trim_with_regions_4 = TrimWithRegions(Curve=join_curves, Regions=move_2.Geometry)  # -> Inside, flatten(Outside)
number_3 = Number(0.1)
# Join all curves into one final curve.
join_curves_2 = JoinCurves(Curves=[trim_with_regions_3.Inside, trim_with_regions_4.Outside], Preserve=False)
addition_2 = Addition(A=rectangle_width, B=number_3)
addition_3 = Addition(A=number_3, B=rectangle_height)
# input values that specify the number of curves to draw in both the x and y direction.
number_slider = Slider(6, range=0..30)
rectangle_3 = Rectangle(Plane=PlaneXY(0, 0, 0), XSize=addition_2, YSize=addition_3, Radius=0)  # -> Rectangle, Length
# BAKE ME FOR AN ARRAY OF OBJECTS TO BE LASER CUT.
# Create an array (specifying the number of objects for both the x and y direction) of the resulting curve to be duplicated for laser cutting.
rectangular_array = RectangularArray(Geometry=join_curves_2, Cell=rectangle_3.Rectangle, XCount=number_slider, YCount=Slider(5, range=0..30))  # -> Geometry, Transform
