# Grasshopper definition create-dodecahedrons.gh (Grasshopper 1.0.7)
# plug-ins: Weaverbird

# Thickness of the dodecahedron legs
number_slider = Slider(5, range=0..100)
number_slider_2 = Slider(2, range=0..10)
panel = Panel("Middle dodecahedron radius")
panel_2 = Panel("Outer dodecahedron radius")
panel_3 = Panel("Innermost dodecahedron radius")
weaverbird_s_polylines_dodecahedron = WeaverbirdsPolylinesDodecahedron(Plane=PlaneXY(0, 0, 0), Radius=Slider(12, range=0..100))
weaverbird_s_polylines_dodecahedron_2 = WeaverbirdsPolylinesDodecahedron(Plane=PlaneXY(0, 0, 0), Radius=Slider(19, range=0..100))
weaverbird_s_polylines_dodecahedron_3 = WeaverbirdsPolylinesDodecahedron(Plane=PlaneXY(0, 0, 0), Radius=number_slider)
weaverbird_s_picture_frame = WeaverbirdsPictureFrame(MeshPolylines=weaverbird_s_polylines_dodecahedron, Distance=number_slider_2, InsetType=0)
# Convert polylines to a 2D mesh.
weaverbird_s_picture_frame_2 = WeaverbirdsPictureFrame(MeshPolylines=weaverbird_s_polylines_dodecahedron_2, Distance=number_slider_2, InsetType=0)
weaverbird_s_picture_frame_3 = WeaverbirdsPictureFrame(MeshPolylines=weaverbird_s_polylines_dodecahedron_3, Distance=number_slider_2, InsetType=0)

# ----
# Bake these three objects to create your nested model!
weaverbird_s_mesh_thicken = WeaverbirdsMeshThicken(MeshCurves=weaverbird_s_picture_frame, Distance=number_slider_2, OffsetType=0)
# Convert 2D mesh to 3D.
weaverbird_s_mesh_thicken_2 = WeaverbirdsMeshThicken(MeshCurves=weaverbird_s_picture_frame_2, Distance=number_slider_2, OffsetType=0)
weaverbird_s_mesh_thicken_3 = WeaverbirdsMeshThicken(MeshCurves=weaverbird_s_picture_frame_3, Distance=number_slider_2, OffsetType=0)
