# Grasshopper definition generate-model-v2.gh (Grasshopper 1.0.7)

box_width_height = Slider(50, range=0..100)
slit_width = Slider(10.1, range=0..11)
number_slits_notches = Slider(2, range=0..10)
slit_notch_depth = Slider(3, range=0..10)
notch_width = Slider(10, range=0..11)
box_width_height_2 = Slider(50, range=0..100)
slit_width_2 = Slider(10.1, range=0..11)
number_slits_notches_2 = Slider(2, range=0..10)
notch_width_2 = Slider(10, range=0..11)
slit_notch_depth_2 = Slider(3, range=0..10)
box_width_height_3 = Slider(50, range=0..100)
slit_width_3 = Slider(10.1, range=0..11)
number_slits_notches_3 = Slider(2, range=0..10)
notch_width_3 = Slider(10, range=0..11)
slit_notch_depth_3 = Slider(3, range=0..10)

multiplication = Multiplication(A=notch_width, B=number_slits_notches)
subtraction = Subtraction(A=box_width_height, B=multiplication)
division = Division(A=subtraction, B=number_slits_notches)
addition = Addition(A=notch_width, B=division)
vector_xyz = VectorXYZ(XComponent=addition, YComponent=0, ZComponent=0)  # -> Vector, Length

multiplication_2 = Multiplication(A=notch_width_2, B=number_slits_notches_2)
subtraction_2 = Subtraction(A=box_width_height_2, B=multiplication_2)
division_2 = Division(A=subtraction_2, B=number_slits_notches_2)
addition_2 = Addition(A=notch_width_2, B=division_2)
vector_xyz_2 = VectorXYZ(XComponent=addition_2, YComponent=0, ZComponent=0)  # -> Vector, Length

multiplication_3 = Multiplication(A=slit_width_3, B=number_slits_notches_3)
subtraction_3 = Subtraction(A=box_width_height_3, B=multiplication_3)
division_3 = Division(A=subtraction_3, B=number_slits_notches_3)
addition_3 = Addition(A=slit_width_3, B=division_3)
vector_xyz_3 = VectorXYZ(XComponent=addition_3, YComponent=0, ZComponent=0)  # -> Vector, Length

panel = Panel("Bottom Panel")

integer = Integer(1)
subtraction_4 = Subtraction(A=number_slits_notches, B=integer)
multiplication_4 = Multiplication(A=addition, B=subtraction_4)
addition_4 = Addition(A=notch_width, B=multiplication_4)
subtraction_5 = Subtraction(A=box_width_height, B=addition_4)
integer_2 = Integer(2)
division_4 = Division(A=subtraction_5, B=integer_2)

integer_3 = Integer(1)
subtraction_6 = Subtraction(A=number_slits_notches_2, B=integer_3)
multiplication_5 = Multiplication(A=addition_2, B=subtraction_6)
addition_5 = Addition(A=notch_width_2, B=multiplication_5)
subtraction_7 = Subtraction(A=box_width_height_2, B=addition_5)
integer_4 = Integer(2)
division_5 = Division(A=subtraction_7, B=integer_4)

integer_5 = Integer(1)
subtraction_8 = Subtraction(A=number_slits_notches_3, B=integer_5)
multiplication_6 = Multiplication(A=addition_3, B=subtraction_8)
addition_6 = Addition(A=slit_width_3, B=multiplication_6)
subtraction_9 = Subtraction(A=box_width_height_3, B=addition_6)
integer_6 = Integer(2)
division_6 = Division(A=subtraction_9, B=integer_6)

# ----
# // Set the slits to be equidistant within the box
# (boxWidth - (slithWidth * numberOfSlits)) + slitWidth
# // Center the slidths within the box
# (boxWidth - (((numberOfSlits - 1) * (slitDistance)) + slitWidth)) / 2
number = Number(-1)
multiplication_7 = Multiplication(A=slit_notch_depth, B=number)
panel_2 = Panel("Slit")
panel_3 = Panel("Notch")
rectangle = Rectangle(Plane=PlaneXY(0, 0, 0), XSize=box_width_height, YSize=box_width_height, Radius=0)  # -> Rectangle, Length
rectangle_2 = Rectangle(Plane=PlaneXY(0, 0, 0), XSize=slit_width, YSize=slit_notch_depth, Radius=0)  # -> Rectangle, Length
rectangle_3 = Rectangle(Plane=PlaneXY(0, 0, 0), XSize=notch_width, YSize=slit_notch_depth, Radius=0)  # -> Rectangle, Length
integer_7 = Integer(-1)
number_2 = Number(0.1)
number_3 = Number(-0.1)
multiplication_8 = Multiplication(A=slit_notch_depth, B=integer_7)
number_4 = Number(0.1)
linear_array = LinearArray(Geometry=rectangle_2.Rectangle, Direction=vector_xyz.Vector, Count=number_slits_notches)  # -> Geometry, Transform
addition_7 = Addition(A=number_3, B=box_width_height)
addition_8 = Addition(A=multiplication_7, B=number_2)
addition_9 = Addition(A=multiplication_8, B=number_4)
vector_xyz_4 = VectorXYZ(XComponent=division_4, YComponent=addition_7, ZComponent=0)  # -> Vector, Length
vector_xyz_5 = VectorXYZ(XComponent=division_4, YComponent=addition_9, ZComponent=0)  # -> Vector, Length
linear_array_2 = LinearArray(Geometry=rectangle_3.Rectangle, Direction=vector_xyz.Vector, Count=number_slits_notches)  # -> Geometry, Transform
subtraction_10 = Subtraction(A=box_width_height, B=slit_notch_depth)
number_5 = Number(0.2)
addition_10 = Addition(A=box_width_height, B=slit_notch_depth)
panel_4 = Panel("Bottom Notches")
move = Move(Geometry=linear_array.Geometry, Motion=vector_xyz_4.Vector)  # -> Geometry, Transform
panel_5 = Panel("Top Slits")
move_2 = Move(Geometry=linear_array.Geometry, Motion=vector_xyz_5.Vector)  # -> Geometry, Transform
addition_11 = Addition(A=subtraction_10, B=number_5)
rotate = Rotate(Geometry=move_2.Geometry, Angle=1.570796327, Plane=PlaneXY(0, 0, 0))  # -> Geometry, Transform
panel_6 = Panel("Left Slits")
rotate_2 = Rotate(Geometry=move_2.Geometry, Angle=1.570796327, Plane=PlaneXY(0, 0, 0))  # -> Geometry, Transform
vector_xyz_6 = VectorXYZ(XComponent=addition_11, YComponent=0, ZComponent=0)  # -> Vector, Length
move_3 = Move(Geometry=rotate_2.Geometry, Motion=vector_xyz_6.Vector)  # -> Geometry, Transform
panel_7 = Panel("Right Slits")

vector_xyz_7 = VectorXYZ(XComponent=division_4, YComponent=addition_8, ZComponent=0)  # -> Vector, Length
move_4 = Move(Geometry=linear_array_2.Geometry, Motion=vector_xyz_7.Vector)  # -> Geometry, Transform

trim_with_regions = TrimWithRegions(Curve=rectangle.Rectangle, Regions=move_4.Geometry)  # -> Inside, flatten(Outside)
trim_with_regions_2 = TrimWithRegions(Curve=move_4.Geometry, Regions=rectangle.Rectangle)  # -> Inside, flatten(Outside)
join_curves = JoinCurves(Curves=[trim_with_regions_2.Outside, trim_with_regions.Outside], Preserve=False)  # -> flatten(Curves)
trim_with_regions_3 = TrimWithRegions(Curve=rotate.Geometry, Regions=join_curves)  # -> flatten(Inside), Outside
trim_with_regions_4 = TrimWithRegions(Curve=join_curves, Regions=rotate.Geometry)  # -> Inside, flatten(Outside)
join_curves_2 = JoinCurves(Curves=[trim_with_regions_4.Outside, trim_with_regions_3.Inside], Preserve=False)
trim_with_regions_5 = TrimWithRegions(Curve=join_curves_2, Regions=move_3.Geometry)  # -> Inside, flatten(Outside)
trim_with_regions_6 = TrimWithRegions(Curve=move_3.Geometry, Regions=join_curves_2)  # -> flatten(Inside), Outside
join_curves_3 = JoinCurves(Curves=[trim_with_regions_5.Outside, trim_with_regions_6.Inside], Preserve=False)

# ----
# // Set the slits to be equidistant within the box
# (boxWidth - (slithWidth * numberOfSlits)) + slitWidth
# // Center the slidths within the box
# (boxWidth - (((numberOfSlits - 1) * (slitDistance)) + slitWidth)) / 2
number_6 = Number(-1)
multiplication_9 = Multiplication(A=slit_notch_depth_2, B=number_6)
rectangle_4 = Rectangle(Plane=PlaneXY(0, 0, 0), XSize=box_width_height_2, YSize=box_width_height_2, Radius=0)  # -> Rectangle, Length
rectangle_5 = Rectangle(Plane=PlaneXY(0, 0, 0), XSize=notch_width_2, YSize=slit_notch_depth_2, Radius=0)  # -> Rectangle, Length
number_7 = Number(0.1)
number_8 = Number(-0.1)
number_9 = Number(-0.1)
linear_array_3 = LinearArray(Geometry=rectangle_5.Rectangle, Direction=vector_xyz_2.Vector, Count=number_slits_notches_2)  # -> Geometry, Transform
addition_12 = Addition(A=number_8, B=box_width_height_2)
addition_13 = Addition(A=multiplication_9, B=number_7)
vector_xyz_8 = VectorXYZ(XComponent=division_5, YComponent=addition_12, ZComponent=0)  # -> Vector, Length
vector_xyz_9 = VectorXYZ(XComponent=division_5, YComponent=number_9, ZComponent=0)  # -> Vector, Length
number_10 = Number(-0.2)
addition_14 = Addition(A=box_width_height_2, B=slit_notch_depth_2)
panel_8 = Panel("Bottom Slits")
move_5 = Move(Geometry=linear_array_3.Geometry, Motion=vector_xyz_8.Vector)  # -> Geometry, Transform
move_6 = Move(Geometry=linear_array_3.Geometry, Motion=vector_xyz_9.Vector)  # -> Geometry, Transform
addition_15 = Addition(A=addition_14, B=number_10)
rotate_3 = Rotate(Geometry=move_6.Geometry, Angle=1.570796327, Plane=PlaneXY(0, 0, 0))  # -> Geometry, Transform
rotate_4 = Rotate(Geometry=move_6.Geometry, Angle=1.570796327, Plane=PlaneXY(0, 0, 0))  # -> Geometry, Transform
vector_xyz_10 = VectorXYZ(XComponent=addition_15, YComponent=0, ZComponent=0)  # -> Vector, Length
move_7 = Move(Geometry=rotate_4.Geometry, Motion=vector_xyz_10.Vector)  # -> Geometry, Transform
integer_8 = Integer(55)
vector_xyz_11 = VectorXYZ(XComponent=integer_8, YComponent=integer_8, ZComponent=0)  # -> Vector, Length

vector_xyz_12 = VectorXYZ(XComponent=division_5, YComponent=addition_13, ZComponent=0)  # -> Vector, Length
move_8 = Move(Geometry=linear_array_3.Geometry, Motion=vector_xyz_12.Vector)  # -> Geometry, Transform

trim_with_regions_7 = TrimWithRegions(Curve=move_8.Geometry, Regions=rectangle_4.Rectangle)  # -> Inside, flatten(Outside)
trim_with_regions_8 = TrimWithRegions(Curve=rectangle_4.Rectangle, Regions=move_8.Geometry)  # -> Inside, flatten(Outside)
join_curves_4 = JoinCurves(Curves=[trim_with_regions_8.Outside, trim_with_regions_7.Outside], Preserve=False)
trim_with_regions_9 = TrimWithRegions(Curve=join_curves_4, Regions=rotate_3.Geometry)  # -> Inside, flatten(Outside)
trim_with_regions_10 = TrimWithRegions(Curve=rotate_3.Geometry, Regions=join_curves_4)  # -> Inside, flatten(Outside)
join_curves_5 = JoinCurves(Curves=[trim_with_regions_9.Outside, trim_with_regions_10.Outside], Preserve=False)
trim_with_regions_11 = TrimWithRegions(Curve=join_curves_5, Regions=move_7.Geometry)  # -> Inside, flatten(Outside)
trim_with_regions_12 = TrimWithRegions(Curve=move_7.Geometry, Regions=join_curves_5)  # -> Inside, flatten(Outside)
join_curves_6 = JoinCurves(Curves=[trim_with_regions_11.Outside, trim_with_regions_12.Outside], Preserve=False)
move_9 = Move(Geometry=join_curves_6, Motion=vector_xyz_11.Vector)  # -> Geometry, Transform

# ----
# Trim and join all curves to create one final curve.
# // Set the slits to be equidistant within the box
# (boxWidth - (slithWidth * numberOfSlits)) + slitWidth
# // Center the slidths within the box
# (boxWidth - (((numberOfSlits - 1) * (slitDistance)) + slitWidth)) / 2
rectangle_6 = Rectangle(Plane=PlaneXY(0, 0, 0), XSize=box_width_height_3, YSize=box_width_height_3, Radius=0)  # -> Rectangle, Length
rectangle_7 = Rectangle(Plane=PlaneXY(0, 0, 0), XSize=slit_width_3, YSize=slit_notch_depth_3, Radius=0)  # -> Rectangle, Length
integer_9 = Integer(-1)
subtraction_11 = Subtraction(A=box_width_height_3, B=slit_notch_depth_3)
multiplication_10 = Multiplication(A=slit_notch_depth_3, B=integer_9)
number_11 = Number(0.1)
number_12 = Number(0.1)
linear_array_4 = LinearArray(Geometry=rectangle_7.Rectangle, Direction=vector_xyz_3.Vector, Count=number_slits_notches_3)  # -> Geometry, Transform
addition_16 = Addition(A=number_11, B=subtraction_11)
addition_17 = Addition(A=multiplication_10, B=number_12)
number_13 = Number(-0.1)
vector_xyz_13 = VectorXYZ(XComponent=division_6, YComponent=addition_16, ZComponent=0)  # -> Vector, Length
vector_xyz_14 = VectorXYZ(XComponent=division_6, YComponent=addition_17, ZComponent=0)  # -> Vector, Length
number_14 = Number(0.2)
addition_18 = Addition(A=subtraction_11, B=number_14)
move_10 = Move(Geometry=linear_array_4.Geometry, Motion=vector_xyz_13.Vector)  # -> Geometry, Transform
move_11 = Move(Geometry=linear_array_4.Geometry, Motion=vector_xyz_14.Vector)  # -> Geometry, Transform
rotate_5 = Rotate(Geometry=move_11.Geometry, Angle=1.570796327, Plane=PlaneXY(0, 0, 0))  # -> Geometry, Transform
rotate_6 = Rotate(Geometry=move_11.Geometry, Angle=1.570796327, Plane=PlaneXY(0, 0, 0))  # -> Geometry, Transform
vector_xyz_15 = VectorXYZ(XComponent=addition_18, YComponent=0, ZComponent=0)  # -> Vector, Length
move_12 = Move(Geometry=rotate_6.Geometry, Motion=vector_xyz_15.Vector)  # -> Geometry, Transform
integer_10 = Integer(55)
vector_xyz_16 = VectorXYZ(XComponent=0, YComponent=integer_10, ZComponent=0)  # -> Vector, Length

vector_xyz_17 = VectorXYZ(XComponent=division_6, YComponent=number_13, ZComponent=0)  # -> Vector, Length
move_13 = Move(Geometry=linear_array_4.Geometry, Motion=vector_xyz_17.Vector)  # -> Geometry, Transform

trim_with_regions_13 = TrimWithRegions(Curve=move_13.Geometry, Regions=rectangle_6.Rectangle)  # -> flatten(Inside), Outside
trim_with_regions_14 = TrimWithRegions(Curve=rectangle_6.Rectangle, Regions=move_13.Geometry)  # -> Inside, flatten(Outside)
join_curves_7 = JoinCurves(Curves=[trim_with_regions_13.Inside, trim_with_regions_14.Outside], Preserve=False)  # -> flatten(Curves)
trim_with_regions_15 = TrimWithRegions(Curve=join_curves_7, Regions=move_10.Geometry)  # -> Inside, flatten(Outside)
trim_with_regions_16 = TrimWithRegions(Curve=move_10.Geometry, Regions=join_curves_7)  # -> flatten(Inside), Outside
join_curves_8 = JoinCurves(Curves=[trim_with_regions_15.Outside, trim_with_regions_16.Inside], Preserve=False)
trim_with_regions_17 = TrimWithRegions(Curve=join_curves_8, Regions=rotate_5.Geometry)  # -> Inside, flatten(Outside)
trim_with_regions_18 = TrimWithRegions(Curve=rotate_5.Geometry, Regions=join_curves_8)  # -> flatten(Inside), Outside
join_curves_9 = JoinCurves(Curves=[trim_with_regions_17.Outside, trim_with_regions_18.Inside], Preserve=False)  # -> flatten(Curves)
trim_with_regions_19 = TrimWithRegions(Curve=join_curves_9, Regions=move_12.Geometry)  # -> Inside, flatten(Outside)
trim_with_regions_20 = TrimWithRegions(Curve=move_12.Geometry, Regions=join_curves_9)  # -> flatten(Inside), Outside

join_curves_10 = JoinCurves(Curves=[trim_with_regions_19.Outside, trim_with_regions_20.Inside], Preserve=False)
move_14 = Move(Geometry=join_curves_10, Motion=vector_xyz_16.Vector)  # -> Geometry, Transform
