# Grasshopper definition generate-model-v3.gh (Grasshopper 1.0.7)

box_width_height = Slider(50, range=0..100)
slit_width = Slider(10.1, range=0..11)
number_slits_notches = Slider(2, range=0..10)
slit_notch_depth = Slider(3, range=0..10)
notch_width = Slider(10, range=0..11)
box_width_height_2 = Slider(50, range=0..100)
slit_width_2 = Slider(10.1, range=0..11)
number_slits_notches_2 = Slider(2, range=0..10)
notch_width_2 = Slider(10, range=0..11)
slit_notch_depth_2 = Slider(3, range=0..10)
slit_width_3 = Slider(10.1, range=0..11)
number_slits_notches_3 = Slider(2, range=0..10)
notch_width_3 = Slider(10, range=0..11)
slit_notch_depth_3 = Slider(3, range=0..10)
box_height = Slider(50, range=0..100)

multiplication = Multiplication(A=notch_width, B=number_slits_notches)
subtraction = Subtraction(A=box_width_height, B=multiplication)
# // Set the slits to be equidistant within the box
# (boxWidth - (slithWidth * numberOfSlits)) + slitWidth
division = Division(A=subtraction, B=number_slits_notches)
addition = Addition(A=notch_width, B=division)
vector_xyz = VectorXYZ(XComponent=addition, YComponent=0, ZComponent=0)  # -> Vector, Length

multiplication_2 = Multiplication(A=slit_notch_depth_3, B=number_slits_notches_3)

multiplication_3 = Multiplication(A=notch_width_2, B=number_slits_notches_2)
subtraction_2 = Subtraction(A=box_width_height_2, B=multiplication_3)
division_2 = Division(A=subtraction_2, B=number_slits_notches_2)
addition_2 = Addition(A=notch_width_2, B=division_2)
vector_xyz_2 = VectorXYZ(XComponent=addition_2, YComponent=0, ZComponent=0)  # -> Vector, Length

addition_3 = Addition(A=multiplication_2, B=box_height)
slit = Rectangle(Plane=PlaneXY(0, 0, 0), XSize=slit_width_3, YSize=slit_notch_depth_3, Radius=0)  # -> Rectangle, Length
number_1 = Number(1)
integer_2 = Integer(2)
number = Number(-1)

multiplication_4 = Multiplication(A=slit_width_3, B=number_slits_notches_3)
subtraction_3 = Subtraction(A=box_height, B=multiplication_4)
division_3 = Division(A=subtraction_3, B=number_slits_notches_3)
# SLITS
# 
# // Set the slits to be equidistant within the height of the box (since the width is bigger to account for the thickness of each panel)
# ((boxHeight - (slithWidth * numberOfSlits)) / numberOfSlits) + slitWidth
addition_4 = Addition(A=division_3, B=slit_width_3)
vector_xyz_3 = VectorXYZ(XComponent=addition_4, YComponent=0, ZComponent=0)  # -> Vector, Length
slits = LinearArray(Geometry=slit.Rectangle, Direction=vector_xyz_3.Vector, Count=number_slits_notches_3)  # -> Geometry, Transform

subtraction_4 = Subtraction(A=number_slits_notches_3, B=number_1)
multiplication_5 = Multiplication(A=subtraction_4, B=addition_4)
addition_5 = Addition(A=multiplication_5, B=slit_width_3)
subtraction_5 = Subtraction(A=box_height, B=addition_5)
division_4 = Division(A=subtraction_5, B=integer_2)
vector_xyz_4 = VectorXYZ(XComponent=division_4, YComponent=0, ZComponent=0)  # -> Vector, Length
# LEFT\RIGHT SLITS BEFORE ROTATION
move = Move(Geometry=slits.Geometry, Motion=vector_xyz_4.Vector)  # -> Geometry, Transform

# ----
# // Center the slidths within the box
# (boxWidth - (((numberOfSlits - 1) * (slitDistance)) + slitWidth)) / 2
multiplication_6 = Multiplication(A=slit_notch_depth, B=number)
panel = Panel("Slit")
panel_2 = Panel("Notch")
rectangle = Rectangle(Plane=PlaneXY(0, 0, 0), XSize=box_width_height, YSize=box_width_height, Radius=0)  # -> Rectangle, Length
rectangle_2 = Rectangle(Plane=PlaneXY(0, 0, 0), XSize=slit_width, YSize=slit_notch_depth, Radius=0)  # -> Rectangle, Length
rectangle_3 = Rectangle(Plane=PlaneXY(0, 0, 0), XSize=notch_width, YSize=slit_notch_depth, Radius=0)  # -> Rectangle, Length
integer = Integer(-1)
number_2 = Number(0.1)
number_3 = Number(-0.1)

integer_1 = Integer(-1)
multiplication_7 = Multiplication(A=slit_notch_depth_3, B=integer_1)
number_1_2 = Number(0.1)
addition_6 = Addition(A=multiplication_7, B=number_1_2)
vector_xyz_5 = VectorXYZ(XComponent=0, YComponent=addition_6, ZComponent=0)  # -> Vector, Length
move_2 = Move(Geometry=move.Geometry, Motion=vector_xyz_5.Vector)  # -> Geometry, Transform
rotate = Rotate(Geometry=move_2.Geometry, Angle=1.570796327, Plane=PlaneXY(0, 0, 0))  # -> Geometry, Transform

multiplication_8 = Multiplication(A=slit_notch_depth, B=integer)
number_4 = Number(0.1)
linear_array = LinearArray(Geometry=rectangle_2.Rectangle, Direction=vector_xyz.Vector, Count=number_slits_notches)  # -> Geometry, Transform
addition_7 = Addition(A=number_3, B=box_width_height)
addition_8 = Addition(A=multiplication_6, B=number_2)
addition_9 = Addition(A=multiplication_8, B=number_4)

subtraction_6 = Subtraction(A=addition_3, B=slit_notch_depth_3)
number_2_2 = Number(0.2)
addition_10 = Addition(A=subtraction_6, B=number_2_2)
vector_xyz_6 = VectorXYZ(XComponent=addition_10, YComponent=0, ZComponent=0)  # -> Vector, Length
rotate_2 = Rotate(Geometry=move_2.Geometry, Angle=1.570796327, Plane=PlaneXY(0, 0, 0))  # -> Geometry, Transform
move_3 = Move(Geometry=rotate_2.Geometry, Motion=vector_xyz_6.Vector)  # -> Geometry, Transform

number_1_3 = Number(-0.1)

subtraction_7 = Subtraction(A=number_slits_notches_3, B=number_1)
# // Center the slidths within the box
# 
# // For the bottom slits
# (boxWidth - (((numberOfSlits - 1) * (slitDistance)) + slitWidth)) / 2
# 
# // For the side slits
# (boxWidth - (((numberOfSlits - 1) * (slitDistance)) + slitWidth)) / 2
multiplication_9 = Multiplication(A=subtraction_7, B=addition_4)
addition_11 = Addition(A=multiplication_9, B=slit_width_3)
subtraction_8 = Subtraction(A=addition_3, B=addition_11)
division_5 = Division(A=subtraction_8, B=integer_2)
vector_xyz_7 = VectorXYZ(XComponent=division_5, YComponent=number_1_3, ZComponent=0)  # -> Vector, Length
move_4 = Move(Geometry=slits.Geometry, Motion=vector_xyz_7.Vector)  # -> Geometry, Transform

subtraction_9 = Subtraction(A=box_height, B=slit_notch_depth_3)
number_1_4 = Number(0.1)
addition_12 = Addition(A=number_1_4, B=subtraction_9)
vector_xyz_8 = VectorXYZ(XComponent=division_5, YComponent=addition_12, ZComponent=0)  # -> Vector, Length
move_5 = Move(Geometry=slits.Geometry, Motion=vector_xyz_8.Vector)  # -> Geometry, Transform

linear_array_2 = LinearArray(Geometry=rectangle_3.Rectangle, Direction=vector_xyz.Vector, Count=number_slits_notches)  # -> Geometry, Transform

integer_3 = Integer(1)
subtraction_10 = Subtraction(A=number_slits_notches, B=integer_3)
multiplication_10 = Multiplication(A=addition, B=subtraction_10)
addition_13 = Addition(A=notch_width, B=multiplication_10)
subtraction_11 = Subtraction(A=box_width_height, B=addition_13)
integer_4 = Integer(2)
division_6 = Division(A=subtraction_11, B=integer_4)
vector_xyz_9 = VectorXYZ(XComponent=division_6, YComponent=addition_8, ZComponent=0)  # -> Vector, Length
move_6 = Move(Geometry=linear_array_2.Geometry, Motion=vector_xyz_9.Vector)  # -> Geometry, Transform

vector_xyz_10 = VectorXYZ(XComponent=division_6, YComponent=addition_7, ZComponent=0)  # -> Vector, Length
vector_xyz_11 = VectorXYZ(XComponent=division_6, YComponent=addition_9, ZComponent=0)  # -> Vector, Length
subtraction_12 = Subtraction(A=box_width_height, B=slit_notch_depth)
bounding_rectangle = Rectangle(Plane=PlaneXY(0, 0, 0), XSize=addition_3, YSize=box_height, Radius=0)  # -> Rectangle, Length
number_5 = Number(0.2)
addition_14 = Addition(A=box_width_height, B=slit_notch_depth)
panel_3 = Panel("Bottom Notches")
move_7 = Move(Geometry=linear_array.Geometry, Motion=vector_xyz_10.Vector)  # -> Geometry, Transform
panel_4 = Panel("Top Slits")
move_8 = Move(Geometry=linear_array.Geometry, Motion=vector_xyz_11.Vector)  # -> Geometry, Transform
addition_15 = Addition(A=subtraction_12, B=number_5)
panel_5 = Panel("BOTTOM SLITS")
panel_6 = Panel("TOP SLITS")
rotate_3 = Rotate(Geometry=move_8.Geometry, Angle=1.570796327, Plane=PlaneXY(0, 0, 0))  # -> Geometry, Transform
panel_7 = Panel("Left Slits")
rotate_4 = Rotate(Geometry=move_8.Geometry, Angle=1.570796327, Plane=PlaneXY(0, 0, 0))  # -> Geometry, Transform
vector_xyz_12 = VectorXYZ(XComponent=addition_15, YComponent=0, ZComponent=0)  # -> Vector, Length
panel_8 = Panel("LEFT SLITS")
move_9 = Move(Geometry=rotate_4.Geometry, Motion=vector_xyz_12.Vector)  # -> Geometry, Transform
panel_9 = Panel("Right Slits")
panel_10 = Panel("RIGHT SLITS")
trim_with_regions = TrimWithRegions(Curve=rectangle.Rectangle, Regions=move_6.Geometry)  # -> Inside, flatten(Outside)
trim_with_regions_2 = TrimWithRegions(Curve=move_6.Geometry, Regions=rectangle.Rectangle)  # -> Inside, flatten(Outside)

trim_with_regions_3 = TrimWithRegions(Curve=move_4.Geometry, Regions=bounding_rectangle.Rectangle)  # -> flatten(Inside), Outside
trim_with_regions_4 = TrimWithRegions(Curve=bounding_rectangle.Rectangle, Regions=move_4.Geometry)  # -> Inside, flatten(Outside)
join_curves = JoinCurves(Curves=[trim_with_regions_3.Inside, trim_with_regions_4.Outside], Preserve=False)
trim_with_regions_5 = TrimWithRegions(Curve=join_curves, Regions=move_5.Geometry)  # -> Inside, flatten(Outside)
trim_with_regions_6 = TrimWithRegions(Curve=move_5.Geometry, Regions=join_curves)  # -> flatten(Inside), Outside
join_curves_2 = JoinCurves(Curves=[trim_with_regions_5.Outside, trim_with_regions_6.Inside], Preserve=False)
trim_with_regions_7 = TrimWithRegions(Curve=join_curves_2, Regions=rotate.Geometry)  # -> Inside, flatten(Outside)
trim_with_regions_8 = TrimWithRegions(Curve=rotate.Geometry, Regions=join_curves_2)  # -> flatten(Inside), Outside
join_curves_3 = JoinCurves(Curves=[trim_with_regions_7.Outside, trim_with_regions_8.Inside], Preserve=False)
trim_with_regions_9 = TrimWithRegions(Curve=move_3.Geometry, Regions=join_curves_3)  # -> flatten(Inside), Outside
trim_with_regions_10 = TrimWithRegions(Curve=join_curves_3, Regions=move_3.Geometry)  # -> Inside, flatten(Outside)
join_curves_4 = JoinCurves(Curves=[trim_with_regions_9.Inside, trim_with_regions_10.Outside], Preserve=False)

join_curves_5 = JoinCurves(Curves=[trim_with_regions_2.Outside, trim_with_regions.Outside], Preserve=False)  # -> flatten(Curves)
trim_with_regions_11 = TrimWithRegions(Curve=rotate_3.Geometry, Regions=join_curves_5)  # -> flatten(Inside), Outside
trim_with_regions_12 = TrimWithRegions(Curve=join_curves_5, Regions=rotate_3.Geometry)  # -> Inside, flatten(Outside)
join_curves_6 = JoinCurves(Curves=[trim_with_regions_12.Outside, trim_with_regions_11.Inside], Preserve=False)
trim_with_regions_13 = TrimWithRegions(Curve=join_curves_6, Regions=move_9.Geometry)  # -> Inside, flatten(Outside)
trim_with_regions_14 = TrimWithRegions(Curve=move_9.Geometry, Regions=join_curves_6)  # -> flatten(Inside), Outside
join_curves_7 = JoinCurves(Curves=[trim_with_regions_13.Outside, trim_with_regions_14.Inside], Preserve=False)
number_6 = Number(55)
vector_xyz_13 = VectorXYZ(XComponent=0, YComponent=number_6, ZComponent=0)  # -> Vector, Length
move_10 = Move(Geometry=join_curves_4, Motion=vector_xyz_13.Vector)  # -> Geometry, Transform

integer_5 = Integer(1)
subtraction_13 = Subtraction(A=number_slits_notches_2, B=integer_5)
multiplication_11 = Multiplication(A=addition_2, B=subtraction_13)
addition_16 = Addition(A=notch_width_2, B=multiplication_11)
subtraction_14 = Subtraction(A=box_width_height_2, B=addition_16)
integer_6 = Integer(2)
division_7 = Division(A=subtraction_14, B=integer_6)

# ----
# // Set the slits to be equidistant within the box
# (boxWidth - (slithWidth * numberOfSlits)) + slitWidth
# // Center the slidths within the box
# (boxWidth - (((numberOfSlits - 1) * (slitDistance)) + slitWidth)) / 2
number_7 = Number(-1)
multiplication_12 = Multiplication(A=slit_notch_depth_2, B=number_7)
rectangle_4 = Rectangle(Plane=PlaneXY(0, 0, 0), XSize=box_width_height_2, YSize=box_width_height_2, Radius=0)  # -> Rectangle, Length
rectangle_5 = Rectangle(Plane=PlaneXY(0, 0, 0), XSize=notch_width_2, YSize=slit_notch_depth_2, Radius=0)  # -> Rectangle, Length
number_8 = Number(0.1)
number_9 = Number(-0.1)
number_10 = Number(-0.1)
linear_array_3 = LinearArray(Geometry=rectangle_5.Rectangle, Direction=vector_xyz_2.Vector, Count=number_slits_notches_2)  # -> Geometry, Transform
addition_17 = Addition(A=number_9, B=box_width_height_2)
addition_18 = Addition(A=multiplication_12, B=number_8)
vector_xyz_14 = VectorXYZ(XComponent=division_7, YComponent=addition_17, ZComponent=0)  # -> Vector, Length
vector_xyz_15 = VectorXYZ(XComponent=division_7, YComponent=number_10, ZComponent=0)  # -> Vector, Length
number_11 = Number(-0.2)
addition_19 = Addition(A=box_width_height_2, B=slit_notch_depth_2)
panel_11 = Panel("Bottom Slits")
move_11 = Move(Geometry=linear_array_3.Geometry, Motion=vector_xyz_14.Vector)  # -> Geometry, Transform
move_12 = Move(Geometry=linear_array_3.Geometry, Motion=vector_xyz_15.Vector)  # -> Geometry, Transform
addition_20 = Addition(A=addition_19, B=number_11)
rotate_5 = Rotate(Geometry=move_12.Geometry, Angle=1.570796327, Plane=PlaneXY(0, 0, 0))  # -> Geometry, Transform
rotate_6 = Rotate(Geometry=move_12.Geometry, Angle=1.570796327, Plane=PlaneXY(0, 0, 0))  # -> Geometry, Transform
vector_xyz_16 = VectorXYZ(XComponent=addition_20, YComponent=0, ZComponent=0)  # -> Vector, Length
move_13 = Move(Geometry=rotate_6.Geometry, Motion=vector_xyz_16.Vector)  # -> Geometry, Transform
integer_7 = Integer(55)
vector_xyz_17 = VectorXYZ(XComponent=integer_7, YComponent=integer_7, ZComponent=0)  # -> Vector, Length

vector_xyz_18 = VectorXYZ(XComponent=division_7, YComponent=addition_18, ZComponent=0)  # -> Vector, Length
move_14 = Move(Geometry=linear_array_3.Geometry, Motion=vector_xyz_18.Vector)  # -> Geometry, Transform

trim_with_regions_15 = TrimWithRegions(Curve=move_14.Geometry, Regions=rectangle_4.Rectangle)  # -> Inside, flatten(Outside)
trim_with_regions_16 = TrimWithRegions(Curve=rectangle_4.Rectangle, Regions=move_14.Geometry)  # -> Inside, flatten(Outside)
join_curves_8 = JoinCurves(Curves=[trim_with_regions_16.Outside, trim_with_regions_15.Outside], Preserve=False)
trim_with_regions_17 = TrimWithRegions(Curve=join_curves_8, Regions=rotate_5.Geometry)  # -> Inside, flatten(Outside)
trim_with_regions_18 = TrimWithRegions(Curve=rotate_5.Geometry, Regions=join_curves_8)  # -> Inside, flatten(Outside)
join_curves_9 = JoinCurves(Curves=[trim_with_regions_17.Outside, trim_with_regions_18.Outside], Preserve=False)
trim_with_regions_19 = TrimWithRegions(Curve=join_curves_9, Regions=move_13.Geometry)  # -> Inside, flatten(Outside)
trim_with_regions_20 = TrimWithRegions(Curve=move_13.Geometry, Regions=join_curves_9)  # -> Inside, flatten(Outside)
join_curves_10 = JoinCurves(Curves=[trim_with_regions_19.Outside, trim_with_regions_20.Outside], Preserve=False)
move_15 = Move(Geometry=join_curves_10, Motion=vector_xyz_17.Vector)  # -> Geometry, Transform
