# Grasshopper definition generate-model.gh (Grasshopper 1.0.7)

box_width_height = Slider(50, range=0..100)
slit_notch_width = Slider(10, range=0..11)
slit_notch_depth = Slider(3, range=0..10)
number_slits_notches = Slider(2, range=0..10)

multiplication = Multiplication(A=slit_notch_width, B=number_slits_notches)
subtraction = Subtraction(A=box_width_height, B=multiplication)
division = Division(A=subtraction, B=number_slits_notches)
addition = Addition(A=slit_notch_width, B=division)
vector_xyz = VectorXYZ(XComponent=addition, YComponent=0, ZComponent=0)  # -> Vector, Length

multiplication_2 = Multiplication(A=slit_notch_width, B=number_slits_notches)
subtraction_2 = Subtraction(A=box_width_height, B=multiplication_2)
division_2 = Division(A=subtraction_2, B=number_slits_notches)
addition_2 = Addition(A=slit_notch_width, B=division_2)
vector_xyz_2 = VectorXYZ(XComponent=addition_2, YComponent=0, ZComponent=0)  # -> Vector, Length

multiplication_3 = Multiplication(A=slit_notch_width, B=number_slits_notches)
subtraction_3 = Subtraction(A=box_width_height, B=multiplication_3)
division_3 = Division(A=subtraction_3, B=number_slits_notches)
addition_3 = Addition(A=slit_notch_width, B=division_3)
vector_xyz_3 = VectorXYZ(XComponent=addition_3, YComponent=0, ZComponent=0)  # -> Vector, Length

panel = Panel("Bottom Panel")
panel_2 = Panel("Front/Back Panels")
panel_3 = Panel("Side Panels")

integer = Integer(1)
subtraction_4 = Subtraction(A=number_slits_notches, B=integer)
multiplication_4 = Multiplication(A=addition_2, B=subtraction_4)
addition_4 = Addition(A=slit_notch_width, B=multiplication_4)
subtraction_5 = Subtraction(A=box_width_height, B=addition_4)
integer_2 = Integer(2)
division_4 = Division(A=subtraction_5, B=integer_2)

integer_3 = Integer(1)
subtraction_6 = Subtraction(A=number_slits_notches, B=integer_3)
multiplication_5 = Multiplication(A=addition, B=subtraction_6)
addition_5 = Addition(A=slit_notch_width, B=multiplication_5)
subtraction_7 = Subtraction(A=box_width_height, B=addition_5)
integer_4 = Integer(2)
division_5 = Division(A=subtraction_7, B=integer_4)

integer_5 = Integer(1)
subtraction_8 = Subtraction(A=number_slits_notches, B=integer_5)
multiplication_6 = Multiplication(A=addition_3, B=subtraction_8)
addition_6 = Addition(A=slit_notch_width, B=multiplication_6)
subtraction_9 = Subtraction(A=box_width_height, B=addition_6)
integer_6 = Integer(2)
division_6 = Division(A=subtraction_9, B=integer_6)

# ----
# // Set the slits to be equidistant within the box
# (boxWidth - (slithWidth * numberOfSlits)) + slitWidth
# // Center the slidths within the box
# (boxWidth - (((numberOfSlits - 1) * (slitDistance)) + slitWidth)) / 2
integer_7 = Integer(-1)
multiplication_7 = Multiplication(A=slit_notch_depth, B=integer_7)
rectangle = Rectangle(Plane=PlaneXY(0, 0, 0), XSize=box_width_height, YSize=box_width_height, Radius=0)  # -> Rectangle, Length
rectangle_2 = Rectangle(Plane=PlaneXY(0, 0, 0), XSize=slit_notch_width, YSize=slit_notch_depth, Radius=0)  # -> Rectangle, Length
integer_8 = Integer(-1)
subtraction_10 = Subtraction(A=box_width_height, B=slit_notch_depth)
multiplication_8 = Multiplication(A=slit_notch_depth, B=integer_8)
number = Number(0.1)
number_2 = Number(0.1)
number_3 = Number(0.1)
addition_7 = Addition(A=multiplication_7, B=number)
linear_array = LinearArray(Geometry=rectangle_2.Rectangle, Direction=vector_xyz_3.Vector, Count=number_slits_notches)  # -> Geometry, Transform
addition_8 = Addition(A=number_2, B=subtraction_10)
addition_9 = Addition(A=multiplication_8, B=number_3)
vector_xyz_4 = VectorXYZ(XComponent=division_6, YComponent=addition_8, ZComponent=0)  # -> Vector, Length
vector_xyz_5 = VectorXYZ(XComponent=division_6, YComponent=addition_9, ZComponent=0)  # -> Vector, Length
number_4 = Number(0.2)
addition_10 = Addition(A=subtraction_10, B=number_4)
panel_4 = Panel("Bottom Slits")
panel_5 = Panel("Top Slits")
move = Move(Geometry=linear_array.Geometry, Motion=vector_xyz_4.Vector)  # -> Geometry, Transform
move_2 = Move(Geometry=linear_array.Geometry, Motion=vector_xyz_5.Vector)  # -> Geometry, Transform
panel_6 = Panel("Left Slits")
rotate = Rotate(Geometry=move_2.Geometry, Angle=1.570796327, Plane=PlaneXY(0, 0, 0))  # -> Geometry, Transform
rotate_2 = Rotate(Geometry=move_2.Geometry, Angle=1.570796327, Plane=PlaneXY(0, 0, 0))  # -> Geometry, Transform
vector_xyz_6 = VectorXYZ(XComponent=addition_10, YComponent=0, ZComponent=0)  # -> Vector, Length
move_3 = Move(Geometry=rotate_2.Geometry, Motion=vector_xyz_6.Vector)  # -> Geometry, Transform
panel_7 = Panel("Right Slits")
integer_9 = Integer(55)
integer_10 = Integer(110)
vector_xyz_7 = VectorXYZ(XComponent=integer_10, YComponent=integer_9, ZComponent=0)  # -> Vector, Length

vector_xyz_8 = VectorXYZ(XComponent=division_6, YComponent=addition_7, ZComponent=0)  # -> Vector, Length
move_4 = Move(Geometry=linear_array.Geometry, Motion=vector_xyz_8.Vector)  # -> Geometry, Transform

# ----
# // Set the slits to be equidistant within the box
# (boxWidth - (slithWidth * numberOfSlits)) + slitWidth
# // Center the slidths within the box
# (boxWidth - (((numberOfSlits - 1) * (slitDistance)) + slitWidth)) / 2
integer_11 = Integer(-1)
rectangle_3 = Rectangle(Plane=PlaneXY(0, 0, 0), XSize=box_width_height, YSize=box_width_height, Radius=0)  # -> Rectangle, Length
rectangle_4 = Rectangle(Plane=PlaneXY(0, 0, 0), XSize=slit_notch_width, YSize=slit_notch_depth, Radius=0)  # -> Rectangle, Length
multiplication_9 = Multiplication(A=slit_notch_depth, B=integer_11)
number_5 = Number(0.1)
number_6 = Number(-0.1)
addition_11 = Addition(A=multiplication_9, B=number_5)
linear_array_2 = LinearArray(Geometry=rectangle_4.Rectangle, Direction=vector_xyz_2.Vector, Count=number_slits_notches)  # -> Geometry, Transform
addition_12 = Addition(A=number_6, B=box_width_height)
number_7 = Number(-0.1)
vector_xyz_9 = VectorXYZ(XComponent=division_4, YComponent=addition_12, ZComponent=0)  # -> Vector, Length
vector_xyz_10 = VectorXYZ(XComponent=division_4, YComponent=number_7, ZComponent=0)  # -> Vector, Length
addition_13 = Addition(A=box_width_height, B=slit_notch_depth)
number_8 = Number(-0.2)
panel_8 = Panel("Bottom Notches")
panel_9 = Panel("Top Notches")
move_5 = Move(Geometry=linear_array_2.Geometry, Motion=vector_xyz_9.Vector)  # -> Geometry, Transform
move_6 = Move(Geometry=linear_array_2.Geometry, Motion=vector_xyz_10.Vector)  # -> Geometry, Transform
addition_14 = Addition(A=addition_13, B=number_8)
rotate_3 = Rotate(Geometry=move_6.Geometry, Angle=1.570796327, Plane=PlaneXY(0, 0, 0))  # -> Geometry, Transform
panel_10 = Panel("Left Notches")
rotate_4 = Rotate(Geometry=move_6.Geometry, Angle=1.570796327, Plane=PlaneXY(0, 0, 0))  # -> Geometry, Transform
vector_xyz_11 = VectorXYZ(XComponent=addition_14, YComponent=0, ZComponent=0)  # -> Vector, Length
move_7 = Move(Geometry=rotate_4.Geometry, Motion=vector_xyz_11.Vector)  # -> Geometry, Transform
panel_11 = Panel("Right Notches")
integer_12 = Integer(55)
vector_xyz_12 = VectorXYZ(XComponent=integer_12, YComponent=integer_12, ZComponent=0)  # -> Vector, Length

vector_xyz_13 = VectorXYZ(XComponent=division_4, YComponent=addition_11, ZComponent=0)  # -> Vector, Length
move_8 = Move(Geometry=linear_array_2.Geometry, Motion=vector_xyz_13.Vector)  # -> Geometry, Transform

# ----
# Trim and join all curves to create one final curve.
# // Set the slits to be equidistant within the box
# (boxWidth - (slithWidth * numberOfSlits)) + slitWidth
# // Center the slidths within the box
# (boxWidth - (((numberOfSlits - 1) * (slitDistance)) + slitWidth)) / 2
rectangle_5 = Rectangle(Plane=PlaneXY(0, 0, 0), XSize=box_width_height, YSize=box_width_height, Radius=0)  # -> Rectangle, Length
rectangle_6 = Rectangle(Plane=PlaneXY(0, 0, 0), XSize=slit_notch_width, YSize=slit_notch_depth, Radius=0)  # -> Rectangle, Length
integer_13 = Integer(-1)
subtraction_11 = Subtraction(A=box_width_height, B=slit_notch_depth)
multiplication_10 = Multiplication(A=slit_notch_depth, B=integer_13)
number_9 = Number(0.1)
number_10 = Number(0.1)
linear_array_3 = LinearArray(Geometry=rectangle_6.Rectangle, Direction=vector_xyz.Vector, Count=number_slits_notches)  # -> Geometry, Transform
addition_15 = Addition(A=number_9, B=subtraction_11)
addition_16 = Addition(A=multiplication_10, B=number_10)
number_11 = Number(-0.1)
vector_xyz_14 = VectorXYZ(XComponent=division_5, YComponent=addition_15, ZComponent=0)  # -> Vector, Length
vector_xyz_15 = VectorXYZ(XComponent=division_5, YComponent=addition_16, ZComponent=0)  # -> Vector, Length
number_12 = Number(0.2)
addition_17 = Addition(A=subtraction_11, B=number_12)
move_9 = Move(Geometry=linear_array_3.Geometry, Motion=vector_xyz_14.Vector)  # -> Geometry, Transform
move_10 = Move(Geometry=linear_array_3.Geometry, Motion=vector_xyz_15.Vector)  # -> Geometry, Transform
rotate_5 = Rotate(Geometry=move_10.Geometry, Angle=1.570796327, Plane=PlaneXY(0, 0, 0))  # -> Geometry, Transform
rotate_6 = Rotate(Geometry=move_10.Geometry, Angle=1.570796327, Plane=PlaneXY(0, 0, 0))  # -> Geometry, Transform
vector_xyz_16 = VectorXYZ(XComponent=addition_17, YComponent=0, ZComponent=0)  # -> Vector, Length
move_11 = Move(Geometry=rotate_6.Geometry, Motion=vector_xyz_16.Vector)  # -> Geometry, Transform
integer_14 = Integer(55)
vector_xyz_17 = VectorXYZ(XComponent=0, YComponent=integer_14, ZComponent=0)  # -> Vector, Length

vector_xyz_18 = VectorXYZ(XComponent=division_5, YComponent=number_11, ZComponent=0)  # -> Vector, Length
move_12 = Move(Geometry=linear_array_3.Geometry, Motion=vector_xyz_18.Vector)  # -> Geometry, Transform

trim_with_regions = TrimWithRegions(Curve=move_12.Geometry, Regions=rectangle_5.Rectangle)  # -> flatten(Inside), Outside
trim_with_regions_2 = TrimWithRegions(Curve=rectangle_5.Rectangle, Regions=move_12.Geometry)  # -> Inside, flatten(Outside)
join_curves = JoinCurves(Curves=[trim_with_regions.Inside, trim_with_regions_2.Outside], Preserve=False)  # -> flatten(Curves)
trim_with_regions_3 = TrimWithRegions(Curve=join_curves, Regions=move_9.Geometry)  # -> Inside, flatten(Outside)
trim_with_regions_4 = TrimWithRegions(Curve=move_9.Geometry, Regions=join_curves)  # -> flatten(Inside), Outside
join_curves_2 = JoinCurves(Curves=[trim_with_regions_3.Outside, trim_with_regions_4.Inside], Preserve=False)
trim_with_regions_5 = TrimWithRegions(Curve=join_curves_2, Regions=rotate_5.Geometry)  # -> Inside, flatten(Outside)
trim_with_regions_6 = TrimWithRegions(Curve=rotate_5.Geometry, Regions=join_curves_2)  # -> flatten(Inside), Outside
join_curves_3 = JoinCurves(Curves=[trim_with_regions_5.Outside, trim_with_regions_6.Inside], Preserve=False)  # -> flatten(Curves)
trim_with_regions_7 = TrimWithRegions(Curve=join_curves_3, Regions=move_11.Geometry)  # -> Inside, flatten(Outside)
trim_with_regions_8 = TrimWithRegions(Curve=move_11.Geometry, Regions=join_curves_3)  # -> flatten(Inside), Outside

trim_with_regions_9 = TrimWithRegions(Curve=move_4.Geometry, Regions=rectangle_5.Rectangle)  # -> Inside, flatten(Outside)
trim_with_regions_10 = TrimWithRegions(Curve=rectangle_5.Rectangle, Regions=move_4.Geometry)  # -> Inside, flatten(Outside)
join_curves_4 = JoinCurves(Curves=[trim_with_regions_9.Outside, trim_with_regions_10.Outside], Preserve=False)  # -> flatten(Curves)
trim_with_regions_11 = TrimWithRegions(Curve=join_curves_4, Regions=rotate.Geometry)  # -> Inside, flatten(Outside)
trim_with_regions_12 = TrimWithRegions(Curve=rotate.Geometry, Regions=join_curves_4)  # -> flatten(Inside), Outside
join_curves_5 = JoinCurves(Curves=[trim_with_regions_11.Outside, trim_with_regions_12.Inside], Preserve=False)
trim_with_regions_13 = TrimWithRegions(Curve=join_curves_5, Regions=move_3.Geometry)  # -> Inside, flatten(Outside)
trim_with_regions_14 = TrimWithRegions(Curve=move_3.Geometry, Regions=join_curves_5)  # -> flatten(Inside), Outside
join_curves_6 = JoinCurves(Curves=[trim_with_regions_13.Outside, trim_with_regions_14.Inside], Preserve=False)

trim_with_regions_15 = TrimWithRegions(Curve=rectangle_5.Rectangle, Regions=move_8.Geometry)  # -> Inside, flatten(Outside)
trim_with_regions_16 = TrimWithRegions(Curve=move_8.Geometry, Regions=rectangle_5.Rectangle)  # -> flatten(Inside), flatten(Outside)
join_curves_7 = JoinCurves(Curves=[trim_with_regions_16.Outside, trim_with_regions_15.Outside], Preserve=False)  # -> flatten(Curves)
trim_with_regions_17 = TrimWithRegions(Curve=rotate_3.Geometry, Regions=join_curves_7)  # -> Inside, flatten(Outside)
trim_with_regions_18 = TrimWithRegions(Curve=join_curves_7, Regions=rotate_3.Geometry)  # -> Inside, flatten(Outside)
join_curves_8 = JoinCurves(Curves=[trim_with_regions_18.Outside, trim_with_regions_17.Outside], Preserve=False)  # -> flatten(Curves)
trim_with_regions_19 = TrimWithRegions(Curve=join_curves_8, Regions=move_7.Geometry)  # -> Inside, flatten(Outside)
trim_with_regions_20 = TrimWithRegions(Curve=move_7.Geometry, Regions=join_curves_8)  # -> Inside, flatten(Outside)
join_curves_9 = JoinCurves(Curves=[trim_with_regions_19.Outside, trim_with_regions_20.Outside], Preserve=False)

join_curves_10 = JoinCurves(Curves=[trim_with_regions_7.Outside, trim_with_regions_8.Inside], Preserve=False)
move_13 = Move(Geometry=join_curves_10, Motion=vector_xyz_17.Vector)  # -> Geometry, Transform

move_14 = Move(Geometry=join_curves_9, Motion=vector_xyz_12.Vector)  # -> Geometry, Transform

move_15 = Move(Geometry=join_curves_6, Motion=vector_xyz_7.Vector)  # -> Geometry, Transform
