# Grasshopper definition generate-leaves-single-layer.gh (Grasshopper 1.0.7)

# Number of points that make up the curve
number_slider = Slider(4, range=0..20)
range = Range(Domain=Domain(0, 1), Steps=number_slider)
# Bezier graph that defines the curve of the line
graph_mapper = GraphMapper(range, x0=0, x1=1, y0=0, y1=1, container_name="Bezier", cpx=[0, 0.7985605597, 1, 1], cpy=[0, 0, 0.6486599445, 1])
# Defines the rotation of the curve
graph_mapper_2 = GraphMapper(range, x0=0, x1=1, y0=0, y1=1, container_name="Bezier", cpx=[0, 1, 0.75, 1], cpy=[0.2971744537, 0.5049394369, 0.75, 0])

# ----
# Pass values through a multiplier so that we don't have tiny values
number_slider_2 = Slider(65, range=0..100)
multiplication = Multiplication(A=range, B=Slider(60, range=0..100))
multiplication_2 = Multiplication(A=graph_mapper, B=number_slider_2)

expression = Expression(x=graph_mapper_2, y=Slider(0.24, range=0..1), Expression="2*x*y")

# ----
# Move the point so that it is not based at the origin
number_slider_3 = Slider(34, range=0..50)
addition = Addition(A=number_slider_3, B=multiplication)

negative = Negative(Value=expression)
# Represents each point on the curve
construct_point = ConstructPoint(XCoordinate=0, YCoordinate=addition, ZCoordinate=multiplication_2)
rotate = Rotate(Geometry=construct_point, Angle=expression, Plane=PlaneXY(0, 0, 0))  # -> Geometry, Transform
rotate_2 = Rotate(Geometry=construct_point, Angle=negative, Plane=PlaneXY(0, 0, 0))  # -> Geometry, Transform

# ----
# Connect the points on each curve into a line
interpolate = Interpolate(Vertices=rotate.Geometry, Degree=3, Periodic=False, KnotStyle=1)  # -> Curve, Length, Domain
interpolate_2 = Interpolate(Vertices=construct_point, Degree=3, Periodic=False, KnotStyle=1)  # -> Curve, Length, Domain
interpolate_3 = Interpolate(Vertices=rotate_2.Geometry, Degree=3, Periodic=False, KnotStyle=1)  # -> Curve, Length, Domain

vector_xyz = VectorXYZ(XComponent=Slider(0, range=0..10), YComponent=Slider(3, range=0..10), ZComponent=Slider(0, range=0..10))  # -> Vector, Length
# Create a surface from the three curves
loft = Loft(
    Curves=[interpolate.Curve, interpolate_2.Curve, interpolate_3.Curve],
    Options={Adjust=False, Closed=False, LoftEnds=0, LoftSimp=0, LoftType=0, Rebuild=10, Refit=0.01})
extrude = Extrude(Base=loft, Direction=vector_xyz.Vector)
polar_array = PolarArray(Geometry=extrude, Plane=PlaneXY(0, 0, 0), Count=Slider(12, range=0..30), Angle=6.283185307)  # -> Geometry, Transform
