# Grasshopper definition generate-leaves.gh (Grasshopper 1.0.7)

# Number of points that make up the curve
number_slider = Slider(4, range=0..20)
# Number of points that make up the curve
number_slider_2 = Slider(4, range=0..20)
# Number of points that make up the curve
number_slider_3 = Slider(4, range=0..20)
# Number of points that make up the curve
number_slider_4 = Slider(4, range=0..20)
# Number of points that make up the curve
number_slider_5 = Slider(4, range=0..20)
range = Range(Domain=Domain(0, 1), Steps=number_slider)
range_2 = Range(Domain=Domain(0, 1), Steps=number_slider_2)
range_3 = Range(Domain=Domain(0, 1), Steps=number_slider_3)
range_4 = Range(Domain=Domain(0, 1), Steps=number_slider_4)
range_5 = Range(Domain=Domain(0, 1), Steps=number_slider_5)
# Defines the rotation of the curve
graph_mapper = GraphMapper(
    range,
    x0=0,
    x1=1,
    y0=0,
    y1=1,
    container_name="Bezier",
    cpx=[0, 0.4772646129, 1, 1],
    cpy=[0.9376339912, 0.8034305573, 1, 0])
# Bezier graph that defines the curve of the line
graph_mapper_2 = GraphMapper(range, x0=0, x1=1, y0=0, y1=1, container_name="Bezier", cpx=[0, 0.7985605597, 1, 1], cpy=[0, 0, 0.6486599445, 1])
# Defines the rotation of the curve
graph_mapper_3 = GraphMapper(
    range_2,
    x0=0,
    x1=1,
    y0=0,
    y1=1,
    container_name="Bezier",
    cpx=[0, 0.4772646129, 1, 1],
    cpy=[0.9376339912, 0.8034305573, 1, 0])
# Bezier graph that defines the curve of the line
graph_mapper_4 = GraphMapper(range_2, x0=0, x1=1, y0=0, y1=1, container_name="Bezier", cpx=[0, 0.7985605597, 1, 1], cpy=[0, 0, 0.6486599445, 1])
# Defines the rotation of the curve
graph_mapper_5 = GraphMapper(
    range_3,
    x0=0,
    x1=1,
    y0=0,
    y1=1,
    container_name="Bezier",
    cpx=[0, 0.4772646129, 1, 1],
    cpy=[0.9376339912, 0.8034305573, 1, 0])
# Bezier graph that defines the curve of the line
graph_mapper_6 = GraphMapper(range_3, x0=0, x1=1, y0=0, y1=1, container_name="Bezier", cpx=[0, 0.7985605597, 1, 1], cpy=[0, 0, 0.6486599445, 1])
# Defines the rotation of the curve
graph_mapper_7 = GraphMapper(
    range_5,
    x0=0,
    x1=1,
    y0=0,
    y1=1,
    container_name="Bezier",
    cpx=[0, 0.4772646129, 1, 1],
    cpy=[0.9376339912, 0.8034305573, 1, 0])
# Bezier graph that defines the curve of the line
graph_mapper_8 = GraphMapper(range_4, x0=0, x1=1, y0=0, y1=1, container_name="Bezier", cpx=[0, 0.7985605597, 1, 1], cpy=[0, 0, 0.6486599445, 1])
# Defines the rotation of the curve
graph_mapper_9 = GraphMapper(
    range_4,
    x0=0,
    x1=1,
    y0=0,
    y1=1,
    container_name="Bezier",
    cpx=[0, 0.4772646129, 1, 1],
    cpy=[0.9376339912, 0.8034305573, 1, 0])
# Bezier graph that defines the curve of the line
graph_mapper_10 = GraphMapper(range_5, x0=0, x1=1, y0=0, y1=1, container_name="Bezier", cpx=[0, 0.7985605597, 1, 1], cpy=[0, 0, 0.6486599445, 1])

# ----
# Pass values through a multiplier so that we don't have tiny values
number_slider_6 = Slider(174, range=0..250)
multiplication = Multiplication(A=range, B=Slider(41, range=0..100))
multiplication_2 = Multiplication(A=graph_mapper_2, B=number_slider_6)

# ----
# Pass values through a multiplier so that we don't have tiny values
number_slider_7 = Slider(100, range=0..100)
multiplication_3 = Multiplication(A=range_2, B=Slider(55, range=0..100))
multiplication_4 = Multiplication(A=graph_mapper_4, B=number_slider_7)

# ----
# Pass values through a multiplier so that we don't have tiny values
number_slider_8 = Slider(174, range=0..250)
multiplication_5 = Multiplication(A=range_3, B=Slider(28, range=0..100))
multiplication_6 = Multiplication(A=graph_mapper_6, B=number_slider_8)

# ----
# Pass values through a multiplier so that we don't have tiny values
number_slider_9 = Slider(144, range=0..200)
multiplication_7 = Multiplication(A=range_4, B=Slider(50, range=0..100))
multiplication_8 = Multiplication(A=graph_mapper_8, B=number_slider_9)

# ----
# Pass values through a multiplier so that we don't have tiny values
number_slider_10 = Slider(65, range=0..100)
multiplication_9 = Multiplication(A=range_5, B=Slider(60, range=0..100))
multiplication_10 = Multiplication(A=graph_mapper_10, B=number_slider_10)

expression = Expression(x=graph_mapper, y=Slider(0.486, range=0..1), Expression="2*x*y")
expression_2 = Expression(x=graph_mapper_3, y=Slider(0.279, range=0..1), Expression="2*x*y")
expression_3 = Expression(x=graph_mapper_5, y=Slider(0.411, range=0..1), Expression="2*x*y")
expression_4 = Expression(x=graph_mapper_9, y=Slider(0.344, range=0..1), Expression="2*x*y")
expression_5 = Expression(x=graph_mapper_7, y=Slider(0.214, range=0..1), Expression="2*x*y")

# ----
# Move the point so that it is not based at the origin
number_slider_11 = Slider(34, range=0..50)
addition = Addition(A=number_slider_11, B=multiplication)

# ----
# Move the point so that it is not based at the origin
number_slider_12 = Slider(34, range=0..50)
addition_2 = Addition(A=number_slider_12, B=multiplication_3)

# ----
# Move the point so that it is not based at the origin
number_slider_13 = Slider(34, range=0..50)
addition_3 = Addition(A=number_slider_13, B=multiplication_5)

# ----
# Move the point so that it is not based at the origin
number_slider_14 = Slider(34, range=0..50)
addition_4 = Addition(A=number_slider_14, B=multiplication_7)

# ----
# Move the point so that it is not based at the origin
number_slider_15 = Slider(34, range=0..50)
addition_5 = Addition(A=number_slider_15, B=multiplication_9)

negative = Negative(Value=expression)
negative_2 = Negative(Value=expression_2)
negative_3 = Negative(Value=expression_3)
negative_4 = Negative(Value=expression_4)
negative_5 = Negative(Value=expression_5)
# Represents each point on the curve
construct_point = ConstructPoint(XCoordinate=0, YCoordinate=addition, ZCoordinate=multiplication_2)
# Represents each point on the curve
construct_point_2 = ConstructPoint(XCoordinate=0, YCoordinate=addition_2, ZCoordinate=multiplication_4)
# Represents each point on the curve
construct_point_3 = ConstructPoint(XCoordinate=0, YCoordinate=addition_3, ZCoordinate=multiplication_6)
# Represents each point on the curve
construct_point_4 = ConstructPoint(XCoordinate=0, YCoordinate=addition_4, ZCoordinate=multiplication_8)
# Represents each point on the curve
construct_point_5 = ConstructPoint(XCoordinate=0, YCoordinate=addition_5, ZCoordinate=multiplication_10)
rotate = Rotate(Geometry=construct_point, Angle=expression, Plane=PlaneXY(0, 0, 0))  # -> Geometry, Transform
rotate_2 = Rotate(Geometry=construct_point, Angle=negative, Plane=PlaneXY(0, 0, 0))  # -> Geometry, Transform
rotate_3 = Rotate(Geometry=construct_point_2, Angle=expression_2, Plane=PlaneXY(0, 0, 0))  # -> Geometry, Transform
rotate_4 = Rotate(Geometry=construct_point_2, Angle=negative_2, Plane=PlaneXY(0, 0, 0))  # -> Geometry, Transform
rotate_5 = Rotate(Geometry=construct_point_3, Angle=expression_3, Plane=PlaneXY(0, 0, 0))  # -> Geometry, Transform
rotate_6 = Rotate(Geometry=construct_point_3, Angle=negative_3, Plane=PlaneXY(0, 0, 0))  # -> Geometry, Transform
rotate_7 = Rotate(Geometry=construct_point_4, Angle=expression_4, Plane=PlaneXY(0, 0, 0))  # -> Geometry, Transform
rotate_8 = Rotate(Geometry=construct_point_5, Angle=expression_5, Plane=PlaneXY(0, 0, 0))  # -> Geometry, Transform
rotate_9 = Rotate(Geometry=construct_point_4, Angle=negative_4, Plane=PlaneXY(0, 0, 0))  # -> Geometry, Transform
rotate_10 = Rotate(Geometry=construct_point_5, Angle=negative_5, Plane=PlaneXY(0, 0, 0))  # -> Geometry, Transform
# Connect the points on each curve into a line
interpolate = Interpolate(Vertices=rotate.Geometry, Degree=3, Periodic=False, KnotStyle=1)  # -> Curve, Length, Domain
interpolate_2 = Interpolate(Vertices=construct_point, Degree=3, Periodic=False, KnotStyle=1)  # -> Curve, Length, Domain
interpolate_3 = Interpolate(Vertices=rotate_2.Geometry, Degree=3, Periodic=False, KnotStyle=1)  # -> Curve, Length, Domain
# Connect the points on each curve into a line
interpolate_4 = Interpolate(Vertices=rotate_3.Geometry, Degree=3, Periodic=False, KnotStyle=1)  # -> Curve, Length, Domain
interpolate_5 = Interpolate(Vertices=construct_point_2, Degree=3, Periodic=False, KnotStyle=1)  # -> Curve, Length, Domain
interpolate_6 = Interpolate(Vertices=rotate_4.Geometry, Degree=3, Periodic=False, KnotStyle=1)  # -> Curve, Length, Domain
# Connect the points on each curve into a line
interpolate_7 = Interpolate(Vertices=rotate_5.Geometry, Degree=3, Periodic=False, KnotStyle=1)  # -> Curve, Length, Domain
interpolate_8 = Interpolate(Vertices=construct_point_3, Degree=3, Periodic=False, KnotStyle=1)  # -> Curve, Length, Domain
interpolate_9 = Interpolate(Vertices=rotate_6.Geometry, Degree=3, Periodic=False, KnotStyle=1)  # -> Curve, Length, Domain
# Connect the points on each curve into a line
interpolate_10 = Interpolate(Vertices=rotate_7.Geometry, Degree=3, Periodic=False, KnotStyle=1)  # -> Curve, Length, Domain
interpolate_11 = Interpolate(Vertices=construct_point_4, Degree=3, Periodic=False, KnotStyle=1)  # -> Curve, Length, Domain
interpolate_12 = Interpolate(Vertices=rotate_9.Geometry, Degree=3, Periodic=False, KnotStyle=1)  # -> Curve, Length, Domain
# Connect the points on each curve into a line
interpolate_13 = Interpolate(Vertices=rotate_8.Geometry, Degree=3, Periodic=False, KnotStyle=1)  # -> Curve, Length, Domain
interpolate_14 = Interpolate(Vertices=construct_point_5, Degree=3, Periodic=False, KnotStyle=1)  # -> Curve, Length, Domain
interpolate_15 = Interpolate(Vertices=rotate_10.Geometry, Degree=3, Periodic=False, KnotStyle=1)  # -> Curve, Length, Domain
vector_xyz = VectorXYZ(XComponent=Slider(0, range=0..10), YComponent=Slider(3, range=0..10), ZComponent=Slider(0, range=0..10))  # -> Vector, Length
vector_xyz_2 = VectorXYZ(XComponent=Slider(0, range=0..10), YComponent=Slider(3, range=0..10), ZComponent=Slider(0, range=0..10))  # -> Vector, Length
vector_xyz_3 = VectorXYZ(XComponent=Slider(0, range=0..10), YComponent=Slider(3, range=0..10), ZComponent=Slider(0, range=0..10))  # -> Vector, Length
# Create a surface from the three curves
loft = Loft(
    Curves=[interpolate.Curve, interpolate_2.Curve, interpolate_3.Curve],
    Options={Adjust=False, Closed=False, LoftEnds=0, LoftSimp=0, LoftType=0, Rebuild=10, Refit=0.01})
vector_xyz_4 = VectorXYZ(XComponent=Slider(0, range=0..10), YComponent=Slider(3, range=0..10), ZComponent=Slider(0, range=0..10))  # -> Vector, Length
vector_xyz_5 = VectorXYZ(XComponent=Slider(0, range=0..10), YComponent=Slider(-3, range=-3..3), ZComponent=Slider(3, range=0..10))  # -> Vector, Length
# Create a surface from the three curves
loft_2 = Loft(
    Curves=[interpolate_4.Curve, interpolate_5.Curve, interpolate_6.Curve],
    Options={Adjust=False, Closed=False, LoftEnds=0, LoftSimp=0, LoftType=0, Rebuild=10, Refit=0.01})
# Create a surface from the three curves
loft_3 = Loft(
    Curves=[interpolate_7.Curve, interpolate_8.Curve, interpolate_9.Curve],
    Options={Adjust=False, Closed=False, LoftEnds=0, LoftSimp=0, LoftType=0, Rebuild=10, Refit=0.01})
# Create a surface from the three curves
loft_4 = Loft(
    Curves=[interpolate_10.Curve, interpolate_11.Curve, interpolate_12.Curve],
    Options={Adjust=False, Closed=False, LoftEnds=0, LoftSimp=0, LoftType=0, Rebuild=10, Refit=0.01})
# Create a surface from the three curves
loft_5 = Loft(
    Curves=[interpolate_13.Curve, interpolate_14.Curve, interpolate_15.Curve],
    Options={Adjust=False, Closed=False, LoftEnds=0, LoftSimp=0, LoftType=0, Rebuild=10, Refit=0.01})
extrude = Extrude(Base=loft, Direction=vector_xyz.Vector)
extrude_2 = Extrude(Base=loft_2, Direction=vector_xyz_2.Vector)
extrude_3 = Extrude(Base=loft_3, Direction=vector_xyz_3.Vector)
extrude_4 = Extrude(Base=loft_4, Direction=vector_xyz_4.Vector)
extrude_5 = Extrude(Base=loft_5, Direction=vector_xyz_5.Vector)
polar_array = PolarArray(Geometry=extrude, Plane=PlaneXY(0, 0, 0), Count=Slider(8, range=0..30), Angle=6.283185307)  # -> Geometry, Transform
polar_array_2 = PolarArray(Geometry=extrude_2, Plane=PlaneXY(0, 0, 0), Count=Slider(8, range=0..30), Angle=6.283185307)  # -> Geometry, Transform
polar_array_3 = PolarArray(Geometry=extrude_3, Plane=PlaneXY(0, 0, 0), Count=Slider(5, range=0..30), Angle=6.283185307)  # -> Geometry, Transform
polar_array_4 = PolarArray(Geometry=extrude_4, Plane=PlaneXY(0, 0, 0), Count=Slider(8, range=0..30), Angle=6.283185307)  # -> Geometry, Transform
polar_array_5 = PolarArray(Geometry=extrude_5, Plane=PlaneXY(0, 0, 0), Count=Slider(8, range=0..30), Angle=6.283185307)  # -> Geometry, Transform
