# Grasshopper definition Polyhedron-Generator.gh (Grasshopper 1.0.7)
# plug-ins: GhPolyhedra

polyhedra_categories = PolyhedraCategories()
panel = Panel(polyhedra_categories)
list_item = ListItem(List=polyhedra_categories, Index=Slider(0, range=0..45), Wrap=True)
polyhedra_names = PolyhedraNames(Category=list_item)
panel_2 = Panel(polyhedra_names)
list_item_2 = ListItem(List=polyhedra_names, Index=Slider(55, range=0..100), Wrap=True)
polyhedron = Polyhedron(Name=list_item_2, Plane=PlaneXY(0, 0, 0), Scale=Slider(10, range=0..25))  # -> Curves, Meshes, Solid
mesh_join = MeshJoin(Meshes=polyhedron.Meshes)
