# Grasshopper definition AdapterWithThreads.gh (Grasshopper 1.0.7)

# ---- group: ADAPTER INPUTS
# Top Diameter input needs to match moss pole diameter
top_diameter = Slider(38, range=0..100)
# Tapered Height is equal to bottom screw height
bottom_lip_thickness = Slider(4, range=0..10)
cylinder_height = Slider(3, range=0..100)
# INPUTS SHOULD BE CARRIED OVER FROM EXTENDER INPUTS
extender_diameter = Slider(20, range=0..100)
extender_tolerance = Slider(0.5, range=0..2)

# ---- group: BOTTOM SCREW INPUTS
# BOTTOM SCREW INPUTS
# 
# These need to match the anchor base/extender inputs
screw_diameter = Slider(11, range=0..100)
height = Slider(15, range=0..20)
number_of_twists = Slider(5, range=0..10)
twist_size = Slider(2, range=0..10)
twist_shape = Slider(3, range=3..10)
twist_fillet = Slider(0.529, range=0..10)
twist_scale = Slider(0.5, range=0..1)

# ---- group: TOP SCREW INPUTS
# TOP SCREW INPUTS
# 
# These need to match the moss pole inputs
# SCREW DIAMeTER
# TopDiamter - [(ThreadTolerance * 2)+(CapWallThickness * 2)]
# 
# Where TopDiameter = Moss Pole Diameter
height_2 = Slider(10, range=0..20)
number_of_twists_2 = Slider(2.5, range=0..10)
twist_size_2 = Slider(2, range=0..10)
twist_shape_2 = Slider(3, range=3..10)
twist_fillet_2 = Slider(0.529, range=0..10)
twist_scale_2 = Slider(0.5, range=0..1)
thread_tolerance = Slider(0.3, range=0..1)
cap_wall_thickness = Slider(3, range=0..10)

# ---- group: SCREW / Screw Diameter
multiplication = Multiplication(A=cap_wall_thickness, B=2)
multiplication_2 = Multiplication(A=thread_tolerance, B=2)
addition = Addition(A=multiplication_2, B=multiplication)
subtraction = Subtraction(A=top_diameter, B=addition)

# ---- group: Adapter Geometry / Cutting Cylinder for Extender
multiplication_3 = Multiplication(A=extender_tolerance, B=2)
addition_2 = Addition(A=extender_diameter, B=multiplication_3)
division = Division(A=addition_2, B=2)
cylinder = Cylinder(Base=PlaneXY(0, 0, 0), Radius=division, Length=height)

# ---- group: Adapter Geometry
# Create three circles:
#    1) the bottom circle that defines the base of the adapter
#    2) the middle circle that defines the mid section of the adapter
#    3) the top circle that defines the top section of the adapter
# 
# Loft them together to create a single object.
addition_3 = Addition(A=addition_2, B=bottom_lip_thickness)
division_2 = Division(A=top_diameter, B=2)
division_3 = Division(A=addition_3, B=2)
circle = Circle(Plane=PlaneXY(0, 0, 0), Radius=division_2)
circle_2 = Circle(Plane=PlaneXY(0, 0, 0), Radius=division_2)
circle_3 = Circle(Plane=PlaneXY(0, 0, 0), Radius=division_3)
addition_4 = Addition(A=height, B=cylinder_height)
unit_z = UnitZ(Factor=height)
unit_z_2 = UnitZ(Factor=addition_4)
move = Move(Geometry=circle, Motion=unit_z_2)  # -> Geometry, Transform
move_2 = Move(Geometry=circle_2, Motion=unit_z)  # -> Geometry, Transform
boundary_surfaces = BoundarySurfaces(Edges=[circle_3, move_2.Geometry, move.Geometry])
loft_type = Slider(3, range=0..5)
loft_options = LoftOptions(Closed=Toggle(False), Adjust=False, Rebuild=0, Refit=0, Type=loft_type)
loft = Loft(Curves=boundary_surfaces, Options=loft_options)
cap_holes = CapHoles(Brep=loft)
solid_difference = SolidDifference(BrepsA=cap_holes, BrepsB=cylinder)
cap_holes_2 = CapHoles(Brep=solid_difference)

# ----
addition_5 = Addition(A=cylinder_height, B=height)
# Position the threaded nut on top of the adapter
unit_z_3 = UnitZ(Factor=addition_5)

# ---- group: Bottom Screw
# Move the point to the edge of the circle
# Rotate the twist shape along the curve, preserving the orientatino of the shape and cap it to create a solid
# Subtract the cutting surfaces from the threads
# Move the point up to the top of the cap
# Union the threads and the cylinder to create one solid
construct_point = ConstructPoint(XCoordinate=0, YCoordinate=0, ZCoordinate=0)
point = Point(construct_point)
_2 = Number(2)
xy_plane = XYPlane(Origin=point)
division_4 = Division(A=screw_diameter, B=_2)
unit_x = UnitX(Factor=division_4)
unit_z_4 = UnitZ(Factor=height)
circle_4 = Circle(Plane=xy_plane, Radius=division_4)
move_3 = Move(Geometry=point, Motion=unit_x)  # -> Geometry, Transform
move_4 = Move(Geometry=move_3.Geometry, Motion=unit_z_4)  # -> Geometry, Transform
line = Line(StartPoint=move_3.Geometry, EndPoint=move_4.Geometry)

# ---- group: Bottom Screw / Thread Curve
# Rotate the points along the circle
# Connect the points into a single curve
# 360 degrees / number of subdivisions gives you one perfect rotation
number_of_points = Slider(100, range=0..100)
_360 = Number(360)
divide_curve = DivideCurve(Curve=line, Count=number_of_points, Kinks=False)  # -> Points, Tangents, Parameters
division_5 = Division(A=_360, B=number_of_points)
addition_6 = Addition(A=number_of_points, B=1)
multiplication_4 = Multiplication(A=division_5, B=number_of_twists)
series = Series(Start=0, Step=multiplication_4, Count=addition_6)
rotate = Rotate(Geometry=divide_curve.Points, Angle=degrees(series), Plane=xy_plane)  # -> Geometry, Transform
interpolate = Interpolate(Vertices=rotate.Geometry, Degree=3, Periodic=False, KnotStyle=1)  # -> Curve, Length, Domain

# ---- group: Bottom Screw
# Create a surface from our circle and extrude it to create a solid
boundary_surfaces_2 = BoundarySurfaces(Edges=circle_4)
extrude = Extrude(Base=boundary_surfaces_2, Direction=unit_z_4)

# Create the twist shape and position it on the XZ plane at the bottom of the curve
end_points = EndPoints(Curve=interpolate.Curve)  # -> Start, End
xz_plane = XZPlane(Origin=end_points.Start)
polygon = Polygon(Plane=xz_plane, Radius=twist_size, Segments=twist_shape, FilletRadius=twist_fillet)  # -> Polygon, Length

# ---- group: SCREW
# Move the point to the edge of the circle
# Move the point up to the top of the cap
construct_point_2 = ConstructPoint(XCoordinate=0, YCoordinate=0, ZCoordinate=0)
point_2 = Point(construct_point_2)
_2_2 = Number(2)
xy_plane_2 = XYPlane(Origin=point_2)
division_6 = Division(A=subtraction, B=_2_2)
unit_x_2 = UnitX(Factor=division_6)
unit_z_5 = UnitZ(Factor=height_2)
circle_5 = Circle(Plane=xy_plane_2, Radius=division_6)
move_5 = Move(Geometry=point_2, Motion=unit_x_2)  # -> Geometry, Transform
move_6 = Move(Geometry=move_5.Geometry, Motion=unit_z_5)  # -> Geometry, Transform
line_2 = Line(StartPoint=move_5.Geometry, EndPoint=move_6.Geometry)

# ---- group: THREADED NUT / Threaded Nut Outer Wall
offset_curve = OffsetCurve(Curve=circle_5, Distance=thread_tolerance, Corners=1)
offset_curve_2 = OffsetCurve(Curve=offset_curve, Distance=cap_wall_thickness, Corners=1)
boundary_surfaces_3 = BoundarySurfaces(Edges=flatten([offset_curve, offset_curve_2]))
extrude_2 = Extrude(Base=boundary_surfaces_3, Direction=unit_z_5)

# ---- group: SCREW / Thread Curve
# Rotate the points along the circle
# Connect the points into a single curve
# 360 degrees / number of subdivisions gives you one perfect rotation
number_of_points_2 = Slider(100, range=0..100)
_360_2 = Number(360)
divide_curve_2 = DivideCurve(Curve=line_2, Count=number_of_points_2, Kinks=False)  # -> Points, Tangents, Parameters
division_7 = Division(A=_360_2, B=number_of_points_2)
addition_7 = Addition(A=number_of_points_2, B=1)
multiplication_5 = Multiplication(A=division_7, B=number_of_twists_2)
series_2 = Series(Start=0, Step=multiplication_5, Count=addition_7)
rotate_2 = Rotate(Geometry=divide_curve_2.Points, Angle=degrees(series_2), Plane=xy_plane_2)  # -> Geometry, Transform
interpolate_2 = Interpolate(Vertices=rotate_2.Geometry, Degree=3, Periodic=False, KnotStyle=1)  # -> Curve, Length, Domain

# ---- group: SCREW
# Create a surface from our circle and extrude it to create a solid
boundary_surfaces_4 = BoundarySurfaces(Edges=circle_5)
extrude_3 = Extrude(Base=boundary_surfaces_4, Direction=unit_z_5)

# Create the twist shape and position it on the XZ plane at the bottom of the curve
end_points_2 = EndPoints(Curve=interpolate_2.Curve)  # -> Start, End
xz_plane_2 = XZPlane(Origin=end_points_2.Start)
polygon_2 = Polygon(Plane=xz_plane_2, Radius=twist_size_2, Segments=twist_shape_2, FilletRadius=twist_fillet_2)  # -> Polygon, Length

move_7 = Move(Geometry=interpolate_2.Curve, Motion=Vector(0, 0, 10))  # -> Geometry, Transform
scale_nu = ScaleNU(Geometry=polygon_2.Polygon, Plane=xz_plane_2, ScaleX=twist_scale_2, ScaleY=1, ScaleZ=1)  # -> Geometry, Transform

# ---- group: THREADED NUT
# Offset the original twist to provide a tolerance for the threads
offset_curve_3 = OffsetCurve(Curve=scale_nu.Geometry, Distance=thread_tolerance, Corners=1)
sweep2 = Sweep2(Rail1=interpolate_2.Curve, Rail2=move_7.Geometry, Sections=offset_curve_3, SameHeight=False)
cap_holes_3 = CapHoles(Brep=sweep2)

# ----
# Subtract the offset twist from the tube to make a solid
threaded_nut = SolidDifference(BrepsA=extrude_2, BrepsB=cap_holes_3)
move_8 = Move(Geometry=threaded_nut, Motion=unit_z_3)  # -> Geometry, Transform

# ---- group: Bottom Screw (continued)
move_9 = Move(Geometry=interpolate.Curve, Motion=Vector(0, 0, 10))  # -> Geometry, Transform
scale_nu_2 = ScaleNU(Geometry=polygon.Polygon, Plane=xz_plane, ScaleX=twist_scale, ScaleY=1, ScaleZ=1)  # -> Geometry, Transform
sweep2_2 = Sweep2(Rail1=interpolate.Curve, Rail2=move_9.Geometry, Sections=scale_nu_2.Geometry, SameHeight=False)
cap_holes_4 = CapHoles(Brep=sweep2_2)

# ---- group: Bottom Screw / Top Cutting Surface
# Create a box and extrude it down to use as a cutting surface to remove the extraneous parts of the thread.
box = Box(cap_holes_4)
multiplication_6 = Multiplication(A=twist_size, B=1.5)
deconstruct_brep = DeconstructBrep(Brep=box)  # -> reverse(Faces), Edges, Vertices
unit_z_6 = UnitZ(Factor=multiplication_6)
list_item = ListItem(List=deconstruct_brep.Faces, Index=0, Wrap=True)
negative = Negative(Value=unit_z_6)
extrude_4 = Extrude(Base=list_item, Direction=negative)

# ---- group: Bottom Screw / Bottom Cutting Surface
# Mirror the cutting rectangle to the bottom of the object to cut the bottom of the threads
area = Area(Geometry=box)  # -> Area, Centroid
xy_plane_3 = XYPlane(Origin=area.Centroid)
mirror = Mirror(Geometry=extrude_4, Plane=xy_plane_3)  # -> Geometry, Transform

# ---- group: Bottom Screw (continued)
solid_difference_2 = SolidDifference(BrepsA=cap_holes_4, BrepsB=[mirror.Geometry, extrude_4])
screw = SolidUnion(Breps=flatten([solid_difference_2, extrude]))

# ----
solid_union = SolidUnion(Breps=[screw, cap_holes_2])

panel = Panel("BAKE ME")
solid_union_2 = SolidUnion(Breps=[solid_union, move_8.Geometry])
