# Grasshopper definition AnchorAdapter.gh (Grasshopper 1.0.7)

top_diameter = Slider(30, range=0..100)
bottom_diameter = Slider(19, range=0..100)
tapered_height = Slider(8, range=0..100)
cylinder_height = Slider(12, range=0..100)
division = Division(A=top_diameter, B=2)
division_2 = Division(A=bottom_diameter, B=2)
circle = Circle(Plane=PlaneXY(0, 0, 0), Radius=division)
circle_2 = Circle(Plane=PlaneXY(0, 0, 0), Radius=division)
circle_3 = Circle(Plane=PlaneXY(0, 0, 0), Radius=division_2)
addition = Addition(A=tapered_height, B=cylinder_height)
unit_z = UnitZ(Factor=tapered_height)
unit_z_2 = UnitZ(Factor=addition)
move = Move(Geometry=circle, Motion=unit_z_2)  # -> Geometry, Transform
move_2 = Move(Geometry=circle_2, Motion=unit_z)  # -> Geometry, Transform
boundary_surfaces = BoundarySurfaces(Edges=[circle_3, move_2.Geometry, move.Geometry])
loft_type = Slider(3, range=0..5)
loft_options = LoftOptions(Closed=Toggle(False), Adjust=False, Rebuild=0, Refit=0, Type=loft_type)
loft = Loft(Curves=boundary_surfaces, Options=loft_options)
cap_holes = CapHoles(Brep=loft)
