# Grasshopper definition AnchorBase.gh (Grasshopper 1.0.7)

anchor_outer_radius = Slider(25, range=0..25)
anchor_lip_thickness = Slider(2, range=0..10)
anchor_height = Slider(2, range=0..25)
number_of_drainage_slits = Slider(6, range=0..10)
anchor_cross_section_width = Slider(5, range=0..25)

_2 = Number(2)
multiplication = Multiplication(A=anchor_outer_radius, B=_2)
panel = Panel("(OuterRadius * 2) - 2)")
_2_2 = Number(2)
subtraction = Subtraction(A=multiplication, B=_2_2)

# ---- group: Anchor Base Drainage Cutout
subtraction_2 = Subtraction(A=anchor_outer_radius, B=anchor_lip_thickness)
division = Division(A=anchor_height, B=2)
cylinder = Cylinder(Base=PlaneXY(0, 0, 0), Radius=subtraction_2, Length=division)
cap_holes = CapHoles(Brep=cylinder)

# ---- group: Anchor Base Inner Cylinder
# [anchor base outer radius - cross section width)
subtraction_3 = Subtraction(A=anchor_outer_radius, B=anchor_cross_section_width)
cylinder_2 = Cylinder(Base=PlaneXY(0, 0, 0), Radius=subtraction_3, Length=anchor_height)
cap_holes_2 = CapHoles(Brep=cylinder_2)

# ---- group: Anchor Base Outer Cylinder
cylinder_3 = Cylinder(Base=PlaneXY(0, 0, 0), Radius=anchor_outer_radius, Length=anchor_height)
cap_holes_3 = CapHoles(Brep=cylinder_3)

# ----
rectangle = Rectangle(Plane=PlaneXY(0, 0, 0), XSize=anchor_cross_section_width, YSize=subtraction, Radius=0)  # -> Rectangle, Length
# CROSS SECTION PIECE #1
box_rectangle = BoxRectangle(Rectangle=rectangle.Rectangle, Height=anchor_height)

# ---- group: Center the Cross Section Piece
_1 = Number(1)
subtraction_4 = Subtraction(A=anchor_outer_radius, B=_1)
_2_3 = Number(2)
division_2 = Division(A=anchor_cross_section_width, B=_2_3)
negative = Negative(Value=division_2)
negative_2 = Negative(Value=subtraction_4)
vector_xyz = VectorXYZ(XComponent=negative, YComponent=negative_2, ZComponent=0)  # -> Vector, Length
move = Move(Geometry=box_rectangle, Motion=vector_xyz.Vector)  # -> Geometry, Transform

# ----
solid_difference = SolidDifference(BrepsA=cap_holes_3, BrepsB=cap_holes_2)

# ---- group: Duplicate the Cross Section and Rotate It
# CROSS SECTION PIECE #2
move_2 = Move(Geometry=box_rectangle, Motion=vector_xyz.Vector)  # -> Geometry, Transform
rotate = Rotate(Geometry=move_2.Geometry, Angle=1.570796327, Plane=PlaneXY(0, 0, 0))  # -> Geometry, Transform

# ---- group: Drainage Slits
addition = Addition(A=anchor_lip_thickness, B=0.1)
rectangle_2 = Rectangle(Plane=PlaneXY(0, 0, 0), XSize=anchor_lip_thickness, YSize=addition, Radius=0)  # -> Rectangle, Length
box_rectangle_2 = BoxRectangle(Rectangle=rectangle_2.Rectangle, Height=division)
negative_3 = Negative(Value=anchor_outer_radius)
division_3 = Division(A=anchor_lip_thickness, B=-2)
vector_xyz_2 = VectorXYZ(XComponent=division_3, YComponent=negative_3, ZComponent=0)  # -> Vector, Length
move_3 = Move(Geometry=box_rectangle_2, Motion=vector_xyz_2.Vector)  # -> Geometry, Transform
polar_array = PolarArray(Geometry=move_3.Geometry, Plane=PlaneXY(0, 0, 0), Count=number_of_drainage_slits, Angle=6.283185307)  # -> Geometry, Transform

# ----
# Union the anchor and cross sections
solid_union = SolidUnion(Breps=[solid_difference, move.Geometry, rotate.Geometry])
solid_difference_2 = SolidDifference(BrepsA=solid_union, BrepsB=cap_holes)
solid_difference_3 = SolidDifference(BrepsA=solid_difference_2, BrepsB=polar_array.Geometry)
