# Grasshopper definition AnchorBaseWithThreads.gh (Grasshopper 1.0.7)

anchor_lip_thickness = Slider(4, range=0..10)
number_of_drainage_slits = Slider(4, range=0..10)
anchor_outer_radius = Slider(50, range=0..300)
anchor_height = Slider(15, range=0..25)
anchor_cross_section_width = Slider(15, range=0..25)

# ----
# SCREW DIAMETER
# AnchorCrossSectionalWidth - (WallThickness * 2)
# 
# -----------
# SCREW HEIGHT
# equal to anchor height
number_of_twists = Slider(5, range=0..10)
twist_size = Slider(2, range=0..10)
twist_shape = Slider(3, range=3..10)
twist_fillet = Slider(0.529, range=0..10)
twist_scale = Slider(0.5, range=0..1)
thread_tolerance = Slider(0.3, range=0..1)
cap_wall_thickness = Slider(2, range=0..10)

# ---- group: Anchor Base Geometry
_2 = Number(2)
multiplication = Multiplication(A=anchor_outer_radius, B=_2)
panel = Panel("(OuterRadius * 2) - 2)")
_2_2 = Number(2)
subtraction = Subtraction(A=multiplication, B=_2_2)

# ---- group: Anchor Base Geometry / Anchor Base Drainage Cutout
subtraction_2 = Subtraction(A=anchor_outer_radius, B=anchor_lip_thickness)
division = Division(A=anchor_height, B=2)
cylinder = Cylinder(Base=PlaneXY(0, 0, 0), Radius=subtraction_2, Length=division)
cap_holes = CapHoles(Brep=cylinder)

# ---- group: Anchor Base Geometry / Anchor Base Inner Cylinder
# [anchor base outer radius - cross section width)
subtraction_3 = Subtraction(A=anchor_outer_radius, B=anchor_cross_section_width)
cylinder_2 = Cylinder(Base=PlaneXY(0, 0, 0), Radius=subtraction_3, Length=anchor_height)
cap_holes_2 = CapHoles(Brep=cylinder_2)

# ---- group: SCREW
# SCREW DIAMETER
# ---
# AnchorCrossSectionalWidth - (WallThickness * 2)
multiplication_2 = Multiplication(A=cap_wall_thickness, B=2)
subtraction_4 = Subtraction(A=anchor_cross_section_width, B=multiplication_2)

# ---- group: Anchor Base Geometry / Anchor Base Outer Cylinder
cylinder_3 = Cylinder(Base=PlaneXY(0, 0, 0), Radius=anchor_outer_radius, Length=anchor_height)
cap_holes_3 = CapHoles(Brep=cylinder_3)

# ---- group: Anchor Base Geometry / Drainage Slits
addition = Addition(A=anchor_lip_thickness, B=0.1)
rectangle = Rectangle(Plane=PlaneXY(0, 0, 0), XSize=anchor_lip_thickness, YSize=addition, Radius=0)  # -> Rectangle, Length
box_rectangle = BoxRectangle(Rectangle=rectangle.Rectangle, Height=division)
negative = Negative(Value=anchor_outer_radius)
division_2 = Division(A=anchor_lip_thickness, B=-2)
vector_xyz = VectorXYZ(XComponent=division_2, YComponent=negative, ZComponent=0)  # -> Vector, Length
move = Move(Geometry=box_rectangle, Motion=vector_xyz.Vector)  # -> Geometry, Transform
polar_array = PolarArray(Geometry=move.Geometry, Plane=PlaneXY(0, 0, 0), Count=number_of_drainage_slits, Angle=6.283185307)  # -> Geometry, Transform

# ---- group: Anchor Base Geometry / Center the Cross Section Piece
_1 = Number(1)
subtraction_5 = Subtraction(A=anchor_outer_radius, B=_1)
_2_3 = Number(2)
division_3 = Division(A=anchor_cross_section_width, B=_2_3)
negative_2 = Negative(Value=division_3)
negative_3 = Negative(Value=subtraction_5)
vector_xyz_2 = VectorXYZ(XComponent=negative_2, YComponent=negative_3, ZComponent=0)  # -> Vector, Length

# ---- group: SCREW
# Move the point to the edge of the circle
# Rotate the twist shape along the curve, preserving the orientatino of the shape and cap it to create a solid
# Subtract the cutting surfaces from the threads
# Move the point up to the top of the cap
construct_point = ConstructPoint(XCoordinate=0, YCoordinate=0, ZCoordinate=0)
point = Point(construct_point)
_2_4 = Number(2)
xy_plane = XYPlane(Origin=point)
division_4 = Division(A=subtraction_4, B=_2_4)
unit_x = UnitX(Factor=division_4)
unit_z = UnitZ(Factor=anchor_height)
circle = Circle(Plane=xy_plane, Radius=division_4)
move_2 = Move(Geometry=point, Motion=unit_x)  # -> Geometry, Transform
move_3 = Move(Geometry=move_2.Geometry, Motion=unit_z)  # -> Geometry, Transform
line = Line(StartPoint=move_2.Geometry, EndPoint=move_3.Geometry)

# ---- group: THREADED NUT / Threaded Nut Outer Wall
offset_curve = OffsetCurve(Curve=circle, Distance=thread_tolerance, Corners=1)
offset_curve_2 = OffsetCurve(Curve=offset_curve, Distance=cap_wall_thickness, Corners=1)
boundary_surfaces = BoundarySurfaces(Edges=flatten([offset_curve, offset_curve_2]))
extrude = Extrude(Base=boundary_surfaces, Direction=unit_z)

# ---- group: SCREW / Thread Curve
# Rotate the points along the circle
# Connect the points into a single curve
# 360 degrees / number of subdivisions gives you one perfect rotation
number_of_points = Slider(100, range=0..100)
_360 = Number(360)
divide_curve = DivideCurve(Curve=line, Count=number_of_points, Kinks=False)  # -> Points, Tangents, Parameters
division_5 = Division(A=_360, B=number_of_points)
addition_2 = Addition(A=number_of_points, B=1)
multiplication_3 = Multiplication(A=division_5, B=number_of_twists)
series = Series(Start=0, Step=multiplication_3, Count=addition_2)
rotate = Rotate(Geometry=divide_curve.Points, Angle=degrees(series), Plane=xy_plane)  # -> Geometry, Transform
interpolate = Interpolate(Vertices=rotate.Geometry, Degree=3, Periodic=False, KnotStyle=1)  # -> Curve, Length, Domain

# ---- group: SCREW
# Create a surface from our circle and extrude it to create a solid
boundary_surfaces_2 = BoundarySurfaces(Edges=circle)
extrude_2 = Extrude(Base=boundary_surfaces_2, Direction=unit_z)

# Create the twist shape and position it on the XZ plane at the bottom of the curve
end_points = EndPoints(Curve=interpolate.Curve)  # -> Start, End
xz_plane = XZPlane(Origin=end_points.Start)
polygon = Polygon(Plane=xz_plane, Radius=twist_size, Segments=twist_shape, FilletRadius=twist_fillet)  # -> Polygon, Length

# ----
# Extrude a circle that is the same size as the threaded nut component. Use this as a cutting piece to remove from the anchor. Do this twice for the center and offset anchor point.
unit_z_2 = UnitZ(Factor=anchor_height)
subtraction_6 = Subtraction(A=anchor_outer_radius, B=anchor_cross_section_width)
extrude_3 = Extrude(Base=offset_curve_2, Direction=unit_z_2)
addition_3 = Addition(A=subtraction_6, B=2)
unit_y = UnitY(Factor=addition_3)
cap_holes_4 = CapHoles(Brep=extrude_3)
move_4 = Move(Geometry=cap_holes_4, Motion=unit_y)  # -> Geometry, Transform

# ---- group: Anchor Base Geometry
# Union the anchor and cross sections
# CROSS SECTION PIECE #1
rectangle_2 = Rectangle(Plane=PlaneXY(0, 0, 0), XSize=anchor_cross_section_width, YSize=subtraction, Radius=0)  # -> Rectangle, Length
box_rectangle_2 = BoxRectangle(Rectangle=rectangle_2.Rectangle, Height=anchor_height)
solid_difference = SolidDifference(BrepsA=cap_holes_3, BrepsB=cap_holes_2)

# ---- group: Anchor Base Geometry / Center the Cross Section Piece (continued)
move_5 = Move(Geometry=box_rectangle_2, Motion=vector_xyz_2.Vector)  # -> Geometry, Transform

# ---- group: Anchor Base Geometry / Duplicate the Cross Section and Rotate It
# CROSS SECTION PIECE #2
move_6 = Move(Geometry=box_rectangle_2, Motion=vector_xyz_2.Vector)  # -> Geometry, Transform
rotate_2 = Rotate(Geometry=move_6.Geometry, Angle=1.570796327, Plane=PlaneXY(0, 0, 0))  # -> Geometry, Transform

# ---- group: Anchor Base Geometry (continued)
solid_union = SolidUnion(Breps=[solid_difference, move_5.Geometry, rotate_2.Geometry])
solid_difference_2 = SolidDifference(BrepsA=solid_union, BrepsB=cap_holes)
solid_difference_3 = SolidDifference(BrepsA=solid_difference_2, BrepsB=polar_array.Geometry)

# ----
# Subtract the cylinder from the anchor to make room for the threaded nut. Union the threaded nut with the resulting object.
solid_difference_4 = SolidDifference(BrepsA=solid_difference_3, BrepsB=[cap_holes_4, move_4.Geometry])

# ---- group: SCREW (continued)
move_7 = Move(Geometry=interpolate.Curve, Motion=Vector(0, 0, 10))  # -> Geometry, Transform
scale_nu = ScaleNU(Geometry=polygon.Polygon, Plane=xz_plane, ScaleX=twist_scale, ScaleY=1, ScaleZ=1)  # -> Geometry, Transform
sweep2 = Sweep2(Rail1=interpolate.Curve, Rail2=move_7.Geometry, Sections=scale_nu.Geometry, SameHeight=False)
cap_holes_5 = CapHoles(Brep=sweep2)

# ---- group: THREADED NUT
# Offset the original twist to provide a tolerance for the threads
offset_curve_3 = OffsetCurve(Curve=scale_nu.Geometry, Distance=thread_tolerance, Corners=1)
sweep2_2 = Sweep2(Rail1=interpolate.Curve, Rail2=move_7.Geometry, Sections=offset_curve_3, SameHeight=False)
cap_holes_6 = CapHoles(Brep=sweep2_2)

# ---- group: SCREW / Top Cutting Surface
# Create a box and extrude it down to use as a cutting surface to remove the extraneous parts of the thread.
box = Box(cap_holes_5)
multiplication_4 = Multiplication(A=twist_size, B=1.5)
deconstruct_brep = DeconstructBrep(Brep=box)  # -> reverse(Faces), Edges, Vertices
unit_z_3 = UnitZ(Factor=multiplication_4)
list_item = ListItem(List=deconstruct_brep.Faces, Index=0, Wrap=True)
negative_4 = Negative(Value=unit_z_3)
extrude_4 = Extrude(Base=list_item, Direction=negative_4)

# ---- group: SCREW / Bottom Cutting Surface
# Mirror the cutting rectangle to the bottom of the object to cut the bottom of the threads
area = Area(Geometry=box)  # -> Area, Centroid
xy_plane_2 = XYPlane(Origin=area.Centroid)
mirror = Mirror(Geometry=extrude_4, Plane=xy_plane_2)  # -> Geometry, Transform

# ---- group: SCREW (continued)
solid_difference_5 = SolidDifference(BrepsA=cap_holes_5, BrepsB=[mirror.Geometry, extrude_4])

# ----
# Subtract the offset twist from the tube to make a solid
threaded_nut = SolidDifference(BrepsA=extrude, BrepsB=cap_holes_6)
# Union the threads and the cylinder to create one solid
screw = SolidUnion(Breps=flatten([solid_difference_5, extrude_2]))

# ----
# Move the second threaded nut in the Y direction for hte offset anchor point.
move_8 = Move(Geometry=threaded_nut, Motion=unit_y)  # -> Geometry, Transform

panel_2 = Panel("BAKE ME")
solid_union_2 = SolidUnion(Breps=[solid_difference_4, move_8.Geometry, threaded_nut])
