# Grasshopper definition ExtenderWithThreads.gh (Grasshopper 1.0.7)

# ----
# The screw and thread inputs for this piece need to match the screw and thread inputs from the anchor piece selection.
# CAP WALL THICKNESS
# [ExtenderDiameter - ScrewDiamter - (2 * Thread Tolerance)] / 2
extender_diameter = Slider(20, range=0..100)
extender_height = Slider(101, range=0..150)
screw_diameter = Slider(11, range=0..100)
height = Slider(15, range=0..20)
number_of_twists = Slider(5, range=0..10)
twist_size = Slider(2, range=0..10)
twist_shape = Slider(3, range=3..10)
twist_fillet = Slider(0.529, range=0..10)
twist_scale = Slider(0.5, range=0..1)
thread_tolerance = Slider(0.3, range=0..1)

# ---- group: Cap Wall Thickness
multiplication = Multiplication(A=thread_tolerance, B=2)
subtraction = Subtraction(A=extender_diameter, B=screw_diameter)
subtraction_2 = Subtraction(A=subtraction, B=multiplication)
division = Division(A=subtraction_2, B=2)

# ----
# Extender Mid Section Height
# (TotalHeight-ScrewHeight)
subtraction_3 = Subtraction(A=extender_height, B=height)
panel = Panel("Extender Radius")
division_2 = Division(A=extender_diameter, B=2)

# ---- group: Extender Cylinder
cylinder = Cylinder(Base=PlaneXY(0, 0, 0), Radius=division_2, Length=subtraction_3)
cap_holes = CapHoles(Brep=cylinder)

# ----
# Move the extender piece up so that it sits flush on top of the screw
unit_z = UnitZ(Factor=height)
move = Move(Geometry=cap_holes, Motion=unit_z)  # -> Geometry, Transform

# ---- group: SCREW
# Move the point to the edge of the circle
# Rotate the twist shape along the curve, preserving the orientatino of the shape and cap it to create a solid
# Subtract the cutting surfaces from the threads
# Move the point up to the top of the cap
construct_point = ConstructPoint(XCoordinate=0, YCoordinate=0, ZCoordinate=0)
point = Point(construct_point)
_2 = Number(2)
xy_plane = XYPlane(Origin=point)
division_3 = Division(A=screw_diameter, B=_2)
unit_x = UnitX(Factor=division_3)
unit_z_2 = UnitZ(Factor=height)
circle = Circle(Plane=xy_plane, Radius=division_3)
move_2 = Move(Geometry=point, Motion=unit_x)  # -> Geometry, Transform
move_3 = Move(Geometry=move_2.Geometry, Motion=unit_z_2)  # -> Geometry, Transform
line = Line(StartPoint=move_2.Geometry, EndPoint=move_3.Geometry)

# ---- group: SCREW / Thread Curve
# Rotate the points along the circle
# Connect the points into a single curve
# 360 degrees / number of subdivisions gives you one perfect rotation
number_of_points = Slider(100, range=0..100)
_360 = Number(360)
divide_curve = DivideCurve(Curve=line, Count=number_of_points, Kinks=False)  # -> Points, Tangents, Parameters
division_4 = Division(A=_360, B=number_of_points)
addition = Addition(A=number_of_points, B=1)
multiplication_2 = Multiplication(A=division_4, B=number_of_twists)
series = Series(Start=0, Step=multiplication_2, Count=addition)
rotate = Rotate(Geometry=divide_curve.Points, Angle=degrees(series), Plane=xy_plane)  # -> Geometry, Transform
interpolate = Interpolate(Vertices=rotate.Geometry, Degree=3, Periodic=False, KnotStyle=1)  # -> Curve, Length, Domain

# ---- group: THREADED NUT / Threaded Nut Outer Wall
offset_curve = OffsetCurve(Curve=circle, Distance=thread_tolerance, Corners=1)
offset_curve_2 = OffsetCurve(Curve=offset_curve, Distance=division, Corners=1)
boundary_surfaces = BoundarySurfaces(Edges=flatten([offset_curve, offset_curve_2]))
extrude = Extrude(Base=boundary_surfaces, Direction=unit_z_2)

# ---- group: SCREW
# Create a surface from our circle and extrude it to create a solid
boundary_surfaces_2 = BoundarySurfaces(Edges=circle)
extrude_2 = Extrude(Base=boundary_surfaces_2, Direction=unit_z_2)

# Create the twist shape and position it on the XZ plane at the bottom of the curve
end_points = EndPoints(Curve=interpolate.Curve)  # -> Start, End
xz_plane = XZPlane(Origin=end_points.Start)
polygon = Polygon(Plane=xz_plane, Radius=twist_size, Segments=twist_shape, FilletRadius=twist_fillet)  # -> Polygon, Length

move_4 = Move(Geometry=interpolate.Curve, Motion=Vector(0, 0, 10))  # -> Geometry, Transform
scale_nu = ScaleNU(Geometry=polygon.Polygon, Plane=xz_plane, ScaleX=twist_scale, ScaleY=1, ScaleZ=1)  # -> Geometry, Transform
sweep2 = Sweep2(Rail1=interpolate.Curve, Rail2=move_4.Geometry, Sections=scale_nu.Geometry, SameHeight=False)
cap_holes_2 = CapHoles(Brep=sweep2)

# ---- group: THREADED NUT
# Offset the original twist to provide a tolerance for the threads
offset_curve_3 = OffsetCurve(Curve=scale_nu.Geometry, Distance=thread_tolerance, Corners=1)
sweep2_2 = Sweep2(Rail1=interpolate.Curve, Rail2=move_4.Geometry, Sections=offset_curve_3, SameHeight=False)
cap_holes_3 = CapHoles(Brep=sweep2_2)

# ---- group: SCREW / Top Cutting Surface
# Create a box and extrude it down to use as a cutting surface to remove the extraneous parts of the thread.
box = Box(cap_holes_2)
multiplication_3 = Multiplication(A=twist_size, B=1.5)
deconstruct_brep = DeconstructBrep(Brep=box)  # -> reverse(Faces), Edges, Vertices
unit_z_3 = UnitZ(Factor=multiplication_3)
list_item = ListItem(List=deconstruct_brep.Faces, Index=0, Wrap=True)
negative = Negative(Value=unit_z_3)
extrude_3 = Extrude(Base=list_item, Direction=negative)

# ---- group: SCREW / Bottom Cutting Surface
# Mirror the cutting rectangle to the bottom of the object to cut the bottom of the threads
area = Area(Geometry=box)  # -> Area, Centroid
xy_plane_2 = XYPlane(Origin=area.Centroid)
mirror = Mirror(Geometry=extrude_3, Plane=xy_plane_2)  # -> Geometry, Transform

# ---- group: SCREW (continued)
solid_difference = SolidDifference(BrepsA=cap_holes_2, BrepsB=[mirror.Geometry, extrude_3])

# ----
# Union the threads and the cylinder to create one solid
screw = SolidUnion(Breps=flatten([solid_difference, extrude_2]))
# Subtract the offset twist from the tube to make a solid
threaded_nut = SolidDifference(BrepsA=extrude, BrepsB=cap_holes_3)

# ----
# Move the threaded nut piece up so that it sits flush on top of the extender piece
addition_2 = Addition(A=height, B=subtraction_3)
unit_z_4 = UnitZ(Factor=addition_2)
move_5 = Move(Geometry=threaded_nut, Motion=unit_z_4)  # -> Geometry, Transform

panel_2 = Panel("BAKE ME")
solid_union = SolidUnion(Breps=[screw, move_5.Geometry, move.Geometry])
