# Grasshopper definition MossPoleOuterWall.gh (Grasshopper 1.0.7)
# plug-ins: LunchBox, Pufferfish

moss_pole_diameter = Slider(50, range=0..100)
moss_pole_height = Slider(48, range=0..250)
u_division_factor = Slider(6, range=0..10)
v_division_factor = Slider(2, range=0..10)
curve_radius = Slider(0.7, range=0..10)
curve_cap_type = Slider(2, range=0..2)
ring_thickness = Slider(2, range=0..10)
ring_height = Slider(2, range=0..10)

# ---- group: Internal Cylinder
# Create a cylinder to build the structure around
division = Division(A=moss_pole_diameter, B=2)
unit_z = UnitZ(Factor=moss_pole_height)
circle = Circle(Plane=PlaneXY(0, 0, 0), Radius=division)
extrude = Extrude(Base=circle, Direction=unit_z)

# ----
# Ensure that the U and V divisions are always even numbers
integer_division = IntegerDivision(A=moss_pole_height, B=u_division_factor)
integer_division_2 = IntegerDivision(A=moss_pole_diameter, B=v_division_factor)
modulus = Modulus(A=integer_division_2, B=2)
modulus_2 = Modulus(A=integer_division, B=2)
subtraction = Subtraction(A=integer_division_2, B=modulus)
subtraction_2 = Subtraction(A=integer_division, B=modulus_2)

# ---- group: Support Rings
# Create the ring that offers support at the top and bottom, and extrude it
# Mirror the bottom ring and move it ot the top of the pole
negative = Negative(Value=ring_thickness)
division_2 = Division(A=ring_height, B=2)
offset_curve = OffsetCurve(Curve=circle, Distance=negative, Corners=1)
negative_2 = Negative(Value=division_2)
boundary_surfaces = BoundarySurfaces(Edges=flatten([circle, offset_curve]))
unit_z_2 = UnitZ(Factor=ring_height)
unit_z_3 = UnitZ(Factor=negative_2)
extrude_2 = Extrude(Base=boundary_surfaces, Direction=unit_z_2)
move = Move(Geometry=extrude_2, Motion=unit_z_3)  # -> Geometry, Transform
area = Area(Geometry=move.Geometry)  # -> Area, Centroid
mirror = Mirror(Geometry=move.Geometry, Plane=area.Centroid)  # -> Geometry, Transform
unit_z_4 = UnitZ(Factor=moss_pole_height)
move_2 = Move(Geometry=mirror.Geometry, Motion=unit_z_4)  # -> Geometry, Transform

# ---- group: Mesh Structure
# Can easily change out this structure with other options to change the face of the moss pole
diagrid_structure = DiagridStructure(Surface=extrude, UDivisions=subtraction_2, VDivisions=subtraction, Type=True)  # -> StructureLines, StructureNodes
pipe = Pipe(Curve=diagrid_structure.StructureLines, Radius=curve_radius, Caps=curve_cap_type)  # -> flatten(Pipe)

# ----
append_polysurfaces = AppendPolysurfaces(Polysurfaces=[pipe, move_2.Geometry, move.Geometry])
area_2 = Area()  # -> Area, Centroid
area_3 = Area()  # -> Area, Centroid
xy_plane = XYPlane(Origin=area_2.Centroid)
xy_plane_2 = XYPlane(Origin=area_3.Centroid)
mirror_2 = Mirror(Plane=xy_plane)  # -> Geometry, Transform
mirror_3 = Mirror(Plane=xy_plane_2)  # -> Geometry, Transform
