# Grasshopper definition MossPoleWithThreadsgh.gh (Grasshopper 1.0.7)
# plug-ins: LunchBox, Pufferfish

moss_pole_diameter = Slider(38, range=0..100)
moss_pole_height = Slider(48, range=0..250)
u_division_factor = Slider(6, range=0..10)
v_division_factor = Slider(2, range=0..10)
curve_radius = Slider(1, range=0..10)
curve_cap_type = Slider(2, range=0..2)
ring_thickness = Slider(4, range=0..10)
ring_height = Slider(5, range=0..10)

number_of_twists = Slider(2.5, range=0..10)
twist_scale = Slider(0.5, range=0..1)
thread_tolerance = Slider(0.3, range=0..1)
screw_diameter = Slider(31.4, range=0..100)
height = Slider(10, range=0..20)
twist_size = Slider(2, range=0..10)
twist_shape = Slider(3, range=3..10)
twist_fillet = Slider(0.529, range=0..10)
screw_lip_thickness = Slider(2, range=0..10)

# ---- group: Internal Cylinder
# Create a cylinder to build the structure around
division = Division(A=moss_pole_diameter, B=2)
unit_z = UnitZ(Factor=moss_pole_height)
circle = Circle(Plane=PlaneXY(0, 0, 0), Radius=division)
extrude = Extrude(Base=circle, Direction=unit_z)

# ---- group: Support Rings
# Create the ring that offers support at the top and bottom, and extrude it
# Mirror the bottom ring and move it ot the top of the pole
negative = Negative(Value=ring_thickness)
division_2 = Division(A=ring_height, B=2)
offset_curve = OffsetCurve(Curve=circle, Distance=negative, Corners=1)
negative_2 = Negative(Value=division_2)
boundary_surfaces = BoundarySurfaces(Edges=flatten([circle, offset_curve]))
unit_z_2 = UnitZ(Factor=ring_height)
unit_z_3 = UnitZ(Factor=negative_2)
extrude_2 = Extrude(Base=boundary_surfaces, Direction=unit_z_2)
move = Move(Geometry=extrude_2, Motion=unit_z_3)  # -> Geometry, Transform
area = Area(Geometry=move.Geometry)  # -> Area, Centroid
mirror = Mirror(Geometry=move.Geometry, Plane=area.Centroid)  # -> Geometry, Transform
unit_z_4 = UnitZ(Factor=moss_pole_height)
move_2 = Move(Geometry=mirror.Geometry, Motion=unit_z_4)  # -> Geometry, Transform

# ----
# Ensure that the U and V divisions are always even numbers
integer_division = IntegerDivision(A=moss_pole_height, B=u_division_factor)
integer_division_2 = IntegerDivision(A=moss_pole_diameter, B=v_division_factor)
modulus = Modulus(A=integer_division_2, B=2)
modulus_2 = Modulus(A=integer_division, B=2)
subtraction = Subtraction(A=integer_division_2, B=modulus)
subtraction_2 = Subtraction(A=integer_division, B=modulus_2)

# ---- group: THREADED NUT / Threaded Nut Outer Wall / Cap Wall Thickness
subtraction_3 = Subtraction(A=moss_pole_diameter, B=screw_diameter)
multiplication = Multiplication(A=thread_tolerance, B=2)
subtraction_4 = Subtraction(A=subtraction_3, B=multiplication)
division_3 = Division(A=subtraction_4, B=2)

# ---- group: Mesh Structure
# Can easily change out this structure with other options to change the face of the moss pole
diagrid_structure = DiagridStructure(Surface=extrude, UDivisions=subtraction_2, VDivisions=subtraction, Type=True)  # -> StructureLines, StructureNodes
pipe = Pipe(Curve=diagrid_structure.StructureLines, Radius=curve_radius, Caps=curve_cap_type)  # -> flatten(Pipe)

# ---- group: SCREW
# Move the point to the edge of the circle
# Rotate the twist shape along the curve, preserving the orientatino of the shape and cap it to create a solid
# Subtract the cutting surfaces from the threads
# Move the point up to the top of the cap
construct_point = ConstructPoint(XCoordinate=0, YCoordinate=0, ZCoordinate=0)
point = Point(construct_point)
_2 = Number(2)
xy_plane = XYPlane(Origin=point)
division_4 = Division(A=screw_diameter, B=_2)
unit_x = UnitX(Factor=division_4)
unit_z_5 = UnitZ(Factor=height)
circle_2 = Circle(Plane=xy_plane, Radius=division_4)
move_3 = Move(Geometry=point, Motion=unit_x)  # -> Geometry, Transform
move_4 = Move(Geometry=move_3.Geometry, Motion=unit_z_5)  # -> Geometry, Transform
line = Line(StartPoint=move_3.Geometry, EndPoint=move_4.Geometry)

# ---- group: SCREW / Thread Curve
# Rotate the points along the circle
# Connect the points into a single curve
# 360 degrees / number of subdivisions gives you one perfect rotation
number_of_points = Slider(100, range=0..100)
_360 = Number(360)
divide_curve = DivideCurve(Curve=line, Count=number_of_points, Kinks=False)  # -> Points, Tangents, Parameters
division_5 = Division(A=_360, B=number_of_points)
addition = Addition(A=number_of_points, B=1)
multiplication_2 = Multiplication(A=division_5, B=number_of_twists)
series = Series(Start=0, Step=multiplication_2, Count=addition)
rotate = Rotate(Geometry=divide_curve.Points, Angle=degrees(series), Plane=xy_plane)  # -> Geometry, Transform
interpolate = Interpolate(Vertices=rotate.Geometry, Degree=3, Periodic=False, KnotStyle=1)  # -> Curve, Length, Domain

# ---- group: THREADED NUT / Threaded Nut Outer Wall
offset_curve_2 = OffsetCurve(Curve=circle_2, Distance=thread_tolerance, Corners=1)
offset_curve_3 = OffsetCurve(Curve=offset_curve_2, Distance=division_3, Corners=1)
boundary_surfaces_2 = BoundarySurfaces(Edges=flatten([offset_curve_2, offset_curve_3]))
extrude_3 = Extrude(Base=boundary_surfaces_2, Direction=unit_z_5)

# ---- group: SCREW
# Create a surface from our circle and extrude it to create a solid
boundary_surfaces_3 = BoundarySurfaces(Edges=circle_2)
extrude_4 = Extrude(Base=boundary_surfaces_3, Direction=unit_z_5)

# Create the twist shape and position it on the XZ plane at the bottom of the curve
end_points = EndPoints(Curve=interpolate.Curve)  # -> Start, End
xz_plane = XZPlane(Origin=end_points.Start)
polygon = Polygon(Plane=xz_plane, Radius=twist_size, Segments=twist_shape, FilletRadius=twist_fillet)  # -> Polygon, Length

# ---- group: Screw Cutout
# Create a cylinder to cut out of the screw
negative_3 = Negative(Value=screw_lip_thickness)
offset_curve_4 = OffsetCurve(Curve=circle_2, Distance=negative_3, Corners=1)
unit_z_6 = UnitZ(Factor=height)
boundary_surfaces_4 = BoundarySurfaces(Edges=offset_curve_4)
extrude_5 = Extrude(Base=boundary_surfaces_4, Direction=unit_z_6)

# ---- group: SCREW (continued)
move_5 = Move(Geometry=interpolate.Curve, Motion=Vector(0, 0, 10))  # -> Geometry, Transform
scale_nu = ScaleNU(Geometry=polygon.Polygon, Plane=xz_plane, ScaleX=twist_scale, ScaleY=1, ScaleZ=1)  # -> Geometry, Transform
sweep2 = Sweep2(Rail1=interpolate.Curve, Rail2=move_5.Geometry, Sections=scale_nu.Geometry, SameHeight=False)
cap_holes = CapHoles(Brep=sweep2)

# ---- group: THREADED NUT
# Offset the original twist to provide a tolerance for the threads
offset_curve_5 = OffsetCurve(Curve=scale_nu.Geometry, Distance=thread_tolerance, Corners=1)
sweep2_2 = Sweep2(Rail1=interpolate.Curve, Rail2=move_5.Geometry, Sections=offset_curve_5, SameHeight=False)
cap_holes_2 = CapHoles(Brep=sweep2_2)

# ---- group: SCREW / Top Cutting Surface
# Create a box and extrude it down to use as a cutting surface to remove the extraneous parts of the thread.
box = Box(cap_holes)
multiplication_3 = Multiplication(A=twist_size, B=1.5)
deconstruct_brep = DeconstructBrep(Brep=box)  # -> reverse(Faces), Edges, Vertices
unit_z_7 = UnitZ(Factor=multiplication_3)
list_item = ListItem(List=deconstruct_brep.Faces, Index=0, Wrap=True)
negative_4 = Negative(Value=unit_z_7)
extrude_6 = Extrude(Base=list_item, Direction=negative_4)

# ---- group: SCREW / Bottom Cutting Surface
# Mirror the cutting rectangle to the bottom of the object to cut the bottom of the threads
area_2 = Area(Geometry=box)  # -> Area, Centroid
xy_plane_2 = XYPlane(Origin=area_2.Centroid)
mirror_2 = Mirror(Geometry=extrude_6, Plane=xy_plane_2)  # -> Geometry, Transform

# ---- group: SCREW (continued)
solid_difference = SolidDifference(BrepsA=cap_holes, BrepsB=[mirror_2.Geometry, extrude_6])

# ----
# Subtract the offset twist from the tube to make a solid
# Move the threaded nut up MossPoleHeight - ThreadedNutHeight + (RingHeight/2)
threaded_nut = SolidDifference(BrepsA=extrude_3, BrepsB=cap_holes_2)
division_6 = Division(A=ring_height, B=2)
subtraction_5 = Subtraction(A=moss_pole_height, B=height)
addition_2 = Addition(A=division_6, B=subtraction_5)
unit_z_8 = UnitZ(Factor=addition_2)
move_6 = Move(Geometry=threaded_nut, Motion=unit_z_8)  # -> Geometry, Transform

# ----
# Union the threads and the cylinder to create one solid
screw = SolidUnion(Breps=flatten([solid_difference, extrude_4]))

# ----
# Align the screw w/ cutout with the bottom of the moss pole
solid_difference_2 = SolidDifference(BrepsA=screw, BrepsB=extrude_5)
addition_3 = Addition(A=division_2, B=height)
negative_5 = Negative(Value=addition_3)
unit_z_9 = UnitZ(Factor=negative_5)
move_7 = Move(Geometry=solid_difference_2, Motion=unit_z_9)  # -> Geometry, Transform

# ----
# Union the bottom ring and the screw and the top threaded nut
append_polysurfaces = AppendPolysurfaces(Polysurfaces=[move.Geometry, move_7.Geometry, move_6.Geometry])  # -> flatten(Appended)
# Union:
#    2) Moss Pole Cross Sections
#    3) Bottom Screw piece + Top screw piece
append_polysurfaces_2 = AppendPolysurfaces(Polysurfaces=[pipe, append_polysurfaces])
